# Grasshopper definition EXP_21_01_3dPrinter.gh (Grasshopper 1.0.7)
# Copyright: CreativeCommons ShareALikeNotComercial
# plug-ins: Parakeet, Heteroptera, Pufferfish, treesloth01, LunchBox, Human, Kangaroo Components, Karamba3D, Kangaroo2 Components, Anemone, Bifocals

# ---- group: Base rectangle
number_slider = Slider(180, range=0..1000)
centered_rectangle = CenteredRectangle(P="{100,230,0}", A=number_slider, A_2=number_slider)

# ----
curve = Curve(centered_rectangle)

nb_of_division_by_wall = Slider(12, range=0..15)
flip_type = Slider(2, range=0..10)
nb_of_layers = Slider(4, range=0..10)
flip_all_type = Slider(2, range=0..10)
toolpath_offset = Slider(0, range=0..1)
merge = Merge(Data1="True", Data2="False")

# ----
# CATENARY CALCULATOR
set_high_number_of_iterations_just_in_ca = Slider(100, range=0..100)  # "(Set high number of iterations just in case)"
desired_catenary_height_between_2_points = Slider(50, range=0..1000)
decimal_tolerance = Slider(4, range=0..10)
reset_loop = Button()
Z = UnitZ(Factor=1)

decimal_tolerance_2 = Data(decimal_tolerance)

settings_karamba3d = SettingsKaramba3D(menu=[dropdown(2)])  # -> AllSettings, GenericOutput
distance_from_ground_to_find_supports = Panel("0.02")

# ---- group: Setup
# KARAMBA PREVIEW
# Karamba
document_distance_tolerance = DocumentDistanceTolerance()
settings_karamba3d_2 = SettingsKaramba3D(menu=[dropdown(0)])  # -> AllSettings, GenericOutput

# ----
cluster = Cluster_9()  # -> data_4, data_3
cluster_2 = Cluster_11()  # -> data_3, data_4
cluster_3 = Cluster_11()  # -> data_3, data_4
cluster_4 = Cluster_13()  # -> data_3, data_4

cluster_5 = Cluster_7()  # -> data_3, data_4

# ---- group: alternate mesh
number_slider_2 = Slider(30, range=0..100)  # disabled
mesh_surface = MeshSurface(UCount=number_slider_2, VCount=number_slider_2, Overhang=True, Equalize=invert(False))  # disabled
triangulate = Triangulate(Mesh=mesh_surface)  # -> Mesh, Count; disabled

# ---- group: Insert imperfection as gravity
# Gravity
# We are creating fake shear forces to help the structure to break
panel = Panel("0.002")
vec = VectorXYZ(XComponent="0", YComponent=panel, ZComponent="-1")  # -> Vector, Length
merge_2 = Merge(Data1=vec.Vector)

# ---- group: Mesh object
number_slider_3 = Slider(0.008, range=0..0.01)

# ----
# Mesh
# 3cm mesh edges gives acurate results
number_slider_4 = Slider(0.03, range=0..0.1)

# ---- group: Earth
# Material
number_slider_5 = Slider(0.009173, range=0..0.01)
alphat = Panel("0.000033")
matprops = MaterialPropertiesKaramba3D(
    FamilyOfMaterial="Steel",
    Name="S235",
    YoungsModulus_kN_cm2=Slider(0.02385, range=0..0.1),
    InPlaneShearModulus_kN_cm2=number_slider_5,
    TransverseShearModulus_kN_cm2=number_slider_5,
    SpecificWeight_kN_m3=Slider(17.6, range=0..100),
    CoefficientOfThermalExpansion_1_C=alphat,
    YieldStrength_kN_cm2=Slider(0.002285, range=0..0.01),
    mode="Isotrop")

# ---- group: Mesh object / Mesh Breps (Karamba3D)
mesh_breps = MeshBrepsKaramba3D(
    MeshResolution=number_slider_4,
    EdgeRefinementFactor=0.67,
    PointReduction=False,
    SmoothingStepSize=0,
    SmoothingIterations=5)  # -> Mesh, Info

# ---- group: Insert imperfection as gravity / Loads (Karamba3D)
loads = LoadsKaramba3D(Vector=merge_2, mode="Gravity")

# ----
cluster_6 = Cluster_6()  # -> data_2, data_4

# ---- group: Slice curve until it can't reach the required slicing proportions
slicing_distance_min = Slider(1.5, range=0..10)
distance_bewteen_layer_layer_thcikness_2 = Panel("1.5")

# ----
license_karamba3d = LicenseKaramba3D()

number_slider_6 = Slider(0, range=0..100)  # disabled
number_slider_7 = Slider(90, range=0..100)  # disabled

# ---- group: Thickness of the vault
number_slider_8 = Slider(6, range=0..10)

number_slider_9 = Slider(0.5, range=0..1)

# ----
# VAULT THICKNESS ACCORDING TO INFILL
# AND ROPE WIDTH
extend_in_intersections = Slider(10, range=0..20)
distance_selection_threshold = Slider(10, range=0..100)

# ---- group: Infill (the infill curve is flipped
cluster_7 = Cluster_5(
    edgy_smooth=Toggle(False),
    control_perodic_crv_num_connections=Slider(0.16, range=0..1),
    control_perodic_crv_num_picks=Slider(0.35, range=0..1))  # -> periodic_curve_2, bounding_cell_2
data = Data(cluster_7.periodic_curve_2)
data_2 = Data(cluster_7.bounding_cell_2)

# ----
division_position_parameter = Panel("0.75")

# ---- group: PLATE
curve_2 = Curve(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)

# ----
negative = Negative(Value=Slider(120, range=0..1000))
number_slider_10 = Slider(1, range=0..10)

tolerance_resolution = Slider(0.2, range=0.01..10)

noozle_diameter = Slider(2.1, range=0..10)
z_bed_height_offset = Slider(1, range=0..10)
slicing_distance = Slider(5, range=0..20)

z_hop_safety_offset_mm = Slider(2, range=0..5)
jog_speed_f_mm_s = Slider(3000, range=0..5000)
print_speed_f_mm_s = Slider(1000, range=0..3000)
extruding_multiplier_e = Slider(5, range=0..50)
stepsbackairtravelling = Slider(0, range=0..50)

# ---- group: USING ONLY PRESSURE?
number_slider_11 = Slider(150, range=0..1000)
toggle = BooleanToggle(False)

# ----
extend_curve = ExtendCurve(Type=0)
curve_3 = Curve(Tree({0;0;0}: [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], {1;0;0}: [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], {2;0;0}: [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], {3;0;0}: [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], {4;0;0}: [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], {5;0;0}: [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]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))

number_of_vault_in_each_direction = Slider(3, range=0..10)
z_min_value = Slider(20, range=0..100)
z_max_value = Slider(50, range=0..100)
construct_domain = ConstructDomain(DomainStart=z_min_value, DomainEnd=z_max_value)
explode = Explode(Curve=centered_rectangle, Recursive=True)  # -> Segments, Vertices
list_item = ListItem(List=explode.Segments, Index=0, Wrap=True)  # -> Item, Item1, Item2, Item3
range = Range(Domain=construct_domain, Steps=number_of_vault_in_each_direction)
range_2 = Range(Domain=construct_domain, Steps=number_of_vault_in_each_direction)

divide_curve = DivideCurve(Curve=list_item.Item, Count=number_of_vault_in_each_direction, Kinks=False)  # -> Points, Tangents, Parameters
divide_curve_2 = DivideCurve(Curve=list_item.Item1, Count=number_of_vault_in_each_direction, Kinks=False)  # -> Points, Tangents, Parameters
divide_curve_3 = DivideCurve(Curve=list_item.Item2, Count=number_of_vault_in_each_direction, Kinks=False)  # -> Points, Tangents, Parameters
divide_curve_4 = DivideCurve(Curve=list_item.Item3, Count=number_of_vault_in_each_direction, Kinks=False)  # -> Points, Tangents, Parameters

reverse_list = ReverseList(List=divide_curve.Points)
reverse_list_2 = ReverseList(List=divide_curve_2.Points)
move_z = MoveZ(G=reverse_list, F=reverse(range))
move_z_2 = MoveZ(G=reverse_list_2, F=range_2)
move_z_3 = MoveZ(G=divide_curve_3.Points, F=range)
move_z_4 = MoveZ(G=divide_curve_4.Points, F=reverse(range_2))
line = Line(StartPoint=move_z, EndPoint=move_z_3)
line_2 = Line(StartPoint=move_z_2, EndPoint=move_z_4)
curve_4 = Curve(flatten([line, line_2]))

curve_5 = Curve(curve_4)
region = NetworkRegions(Curves=curve_5)

list_item_2 = ListItem(List=line, Index=0, Wrap=True)  # -> Item1, Item
list_item_3 = ListItem(List=line_2, Index=0, Wrap=True)  # -> Item1, Item
merge_3 = Merge(Data1=list_item_2.Item1, Data2=list_item_3.Item1, Data3=list_item_2.Item, Data4=list_item_3.Item)
curve_6 = Curve(reverse(merge_3))

# ---- group: Outside curves
cull_pattern = CullPattern(List=curve_5, CullPattern=invert([False, True, True, False]))

# ---- group: Inside curves
cull_pattern_2 = CullPattern(List=curve_5, CullPattern=[False, True, True, False])

# ----
curve_7 = Curve(region)
curve_8 = Curve(flatten(curve_7))

region_2 = NetworkRegions(Curves=curve_8)
cull_pattern_3 = CullPattern(List=curve_8, CullPattern=[False, True, True, False])
cull_pattern_4 = CullPattern(List=curve_8, CullPattern=invert([False, True, True, False]))

# ---- group: Mesh surfaces
# KANGAROO
explode_2 = Explode(Curve=region_2, Recursive=True)  # -> Segments, simplify(Vertices)
duppt = RemoveDuplicatePts(Points=explode_2.Vertices, Tolerance=0.01)  # -> simplify(UniquePoints)
item = ListItem(List=duppt, Index=0, Wrap=True)  # -> Item, Item1, Item2, Item3
srf4pt = _4PointSurface(CornerA=item.Item, CornerB=item.Item1, CornerC=item.Item2, CornerD=item.Item3)
mesh_uv = MeshSurface(Surface=srf4pt, UCount="15", VCount="15", Overhang=True, Equalize=False)

# ---- group: Center of gravity
md_slider = MDSlider(SliderMode=0, slider_value=Point(0.5, 0.5, 0.5), x_domain=Domain(0, 1), y_domain=Domain(0, 1), z_domain=Domain(0, 1))
evalsrf = EvaluateSurface(Surface=reparameterize(srf4pt), Point=md_slider)  # -> Point, simplify(graft(Normal)), UDirection, VDirection, Frame

# ----
edgelengths = EdgeLengths(Mesh=mesh_uv, LengthFactor=Slider(0, range=0..0.1), Strength=1)  # -> simplify(graft(EL))
pshift = ShiftPaths(Data=edgelengths, Offset=-1)

nv = NakedVertices(Mesh=mesh_uv)  # -> ClothedIndex, NakedIndex, simplify(graft(ClothedPts)), NakedPts
pshift_2 = ShiftPaths(Data=nv.ClothedPts, Offset=-1)
anchor = Anchor(Point=nv.NakedPts, Strength=10000)  # -> simplify(graft(A))
pshift_3 = ShiftPaths(Data=anchor, Offset=-1)

amp = Amplitude(Vector=evalsrf.Normal, Amplitude=Slider(1.3, range=0..10))
load = Load(Point=pshift_2, ForceVector=amp, Weighting=1)  # -> simplify(graft(Unary))
pshift_4 = ShiftPaths(Data=load, Offset=-1)

# ---- group: Vault lenght
# FIND CATENARY
discontinuity = Discontinuity(Curve=region_2, Level=1)  # -> Points, Parameters
list_item_4 = ListItem(List=discontinuity.Points, Index=0, Wrap=True)  # -> Item, Item1, Item2, Item3
distance = Distance(PointA=list_item_4.Item, PointB=list_item_4.Item2)
panel_2 = Panel(distance)

# ----
unit_x = UnitX(Factor=1)
xy_plane = XYPlane(Origin=Point(0, 0, 0))
line_sdl = LineSDL(Start=xy_plane, Direction=unit_x, Length=distance)
end_points = EndPoints(Curve=line_sdl)  # -> Start, End

# ---- group: Point A
pt = Point(end_points.Start)

# ---- group: Point B
pt_2 = Point(end_points.End)

# ----
pdecon = Deconstruct(Point=pt_2)  # -> XComponent, YComponent, ZComponent
avr = Average(Input=[pt, pt_2])
addition = Addition(A=pdecon.ZComponent, B=1)
Z_2 = UnitZ(Factor=addition)
move = Move(Geometry=avr, Motion=Z_2)  # -> Geometry, Transform

# ---- group: Get basic polyline length to get the result faster
merge_4 = Merge(Data1=pt, Data2=move.Geometry, Data3=pt_2)
pline = PolyLine(Vertices=merge_4, Closed=False)
len = Length(Curve=pline)

# ----
loop_start = LoopStart(Repeat=set_high_number_of_iterations_just_in_ca, Trigger=reset_loop, Data=len)  # -> port, Counter, Data
loop_counter = Panel(loop_start.Counter)

cat = Catenary(PointA=pt, PointB=pt_2, Length=loop_start.Data, Gravity=Z)

# ---- group: Create plane just above highest point to obtain highest point
pt_3 = ConstructPoint(XCoordinate=0, YCoordinate=0, ZCoordinate=Slider(100000, range=0..100000))
xy = XYPlane(Origin=pt_3)
project = Project(Geometry=cat, Plane=xy)  # -> Geometry, Transform

# ---- group: Final Catenary Curve
crv = Curve(reparameterize(cat))

# ---- group: Half catenary
shatter = Shatter(Curve=crv, Parameters="0.5")
list_item_5 = ListItem(List=shatter, Index=0, Wrap=True)  # -> Item, Item1
curve_9 = Curve(simplify(list_item_5.Item1))

# ---- group: Connection vault point weak
discontinuity_2 = Discontinuity(Curve=region_2, Level=1)  # -> flatten(Points), Parameters
cull_duplicates = CullDuplicates(Points=discontinuity_2.Points, Tolerance=0.1, CullMode=3)  # -> Points, Indices, Valence; disabled
number_of_intersection_to_reinforce_star = Slider(12, range=0..12)  # "Number of intersection to reinforce (starting from center)"
bounding_box = BoundingBox(Content=cull_duplicates.Points, Plane=PlaneXY(0, 0, 0), UnionBox=True)  # -> Box, Box_2; disabled
volume = Volume(Geometry=bounding_box.Box)  # -> Volume, Centroid; disabled
closest_points = ClosestPoints(Point=volume.Centroid, Cloud=cull_duplicates.Points, Count=number_of_intersection_to_reinforce_star)  # -> ClosestPoint, CPIndex, Distance; disabled
point = Point(discontinuity_2.Points)

# ---- group: Offset Base wall
join_curves = JoinCurves(Curves=curve_6, Preserve=False)
offset_wall_2 = Slider(15, range=0..100)
curve_10 = Curve(graft(join_curves))

# ----
curve_11 = Curve(curve)
offset_wall_2_2 = Slider(10, range=0..100)
negative_2 = Negative(Value=offset_wall_2_2)
offset_top_wall_size = Slider(5, range=0..20)

# ---- group: Offset 1
offset_top_wall_size_2 = Slider(10, range=0..20)
curve_12 = Curve(curve_10)
curve_13 = Curve(curve_12)
negative_3 = Negative(Value=offset_top_wall_size)
xy_plane_2 = XYPlane(Origin=Point(0, 0, 0))
offset_curve_loose = OffsetCurveLoose(Curve=curve_13, Distance=offset_top_wall_size_2, Plane=xy_plane_2)
offset_curve_loose_2 = OffsetCurveLoose(Curve=curve_13, Distance=negative_3, Plane=xy_plane_2)

# ---- group: Offset Base wall (continued)
center = Center(Geometric=curve_11)  # -> Center, Dimension
project_2 = Project(Geometry=curve_10, Plane=center.Center)  # -> Geometry, Transform
offset_curve = OffsetCurve(Curve=project_2.Geometry, Plane=center.Center, Distance=offset_wall_2, BothSides=negative_2, Kinks=0, CapType=0)

# ----
curve_14 = Curve(flatten(offset_curve))
curve_15 = Curve(project_2.Geometry)
curve_16 = Curve(offset_curve_loose)
curve_17 = Curve(curve_13)
curve_18 = Curve(offset_curve_loose_2)

# ---- group: Offset Base wall (continued)
list_item_6 = ListItem(List=curve_14, Index=0, Wrap=True)  # -> Item, Item1

# ----
curve_19 = Curve(list_item_6.Item)
curve_20 = Curve(list_item_6.Item1)

explode_3 = Explode(Curve=curve_17, Recursive=True)  # -> reparameterize(Segments), Vertices
explode_4 = Explode(Curve=curve_16, Recursive=True)  # -> Segments, Vertices
# which level
explode_5 = Explode(Curve=curve_18, Recursive=True)  # -> Segments, Vertices
divide_curve_5 = DivideCurve(Curve=explode_3.Segments, Count=nb_of_division_by_wall, Kinks=False)  # -> simplify(Points), Tangents, Parameters
curve_closest_point = CurveClosestPoint(Point=divide_curve_5.Points, Curve=graft(explode_4.Segments))  # -> simplify(Point), Parameter, Distance
curve_closest_point_2 = CurveClosestPoint(Point=divide_curve_5.Points, Curve=graft(explode_5.Segments))  # -> simplify(Point), Parameter, Distance
line_3 = Line(StartPoint=curve_closest_point.Point, EndPoint=curve_closest_point_2.Point)
shift_paths = ShiftPaths(Data=line_3, Offset=-1)
divide_curve_6 = DivideCurve(Curve=shift_paths, Count=nb_of_layers, Kinks=False)  # -> Points, Tangents, Parameters
shatter_2 = Shatter(Curve=graft(shift_paths), Parameters=divide_curve_6.Parameters)  # -> simplify(Segments)
negative_4 = Negative(Value=toolpath_offset)

# ---- group: Find corners
number_slider_12 = Slider(13, range=0..100)
series = Series(Start=Slider(12, range=0..100), Step=number_slider_12, Count=10)
series_2 = Series(Start=0, Step=number_slider_12, Count=10)
tree_statistics = TreeStatistics(Tree=shatter_2)  # -> Paths, Length, Count
list_item_7 = ListItem(List=tree_statistics.Paths, Index=[series_2, series], Wrap=True)
split_tree = SplitTree(Data=shatter_2, Masks=flatten(list_item_7))  # -> Positive, Negative

# ---- group: Scale corners
curve_21 = Curve(split_tree.Positive)
end_points_2 = EndPoints(Curve=curve_21)  # -> Start, End
list_item_8 = ListItem(List=end_points_2.End, Index=0, Wrap=True)  # -> Item1, Item, Item1_2
point_2 = Point(list_item_8.Item1)
scale = Scale(Geometry=curve_21, Center=point_2, Factor=Slider(1, range=0..10))  # -> Geometry, Transform

# ----
merge_5 = Merge(Data1=scale.Geometry, Data2=split_tree.Negative)
flip_matrix = FlipMatrix(Data=merge_5)
extend_curve_2 = ExtendCurve(Curve=flip_matrix, Type=0, Start=negative_4, End=negative_4)
curve_22 = Curve(extend_curve_2)
shift_list = ShiftList(List=curve_22, Shift=1, Wrap=True)  # -> simplify(graft(List))
graft_tree = GraftTree(Tree=curve_22, IncludeEmptyLists=True, IncludeNullItems=True)  # -> simplify(Tree)
loft = Loft(
    Curves=[graft_tree, shift_list],
    Options={Adjust=False, Closed=False, LoftEnds=0, LoftSimp=0, LoftType=3, Rebuild=10, Refit=0.01})  # -> simplify(Loft)
shift_paths_2 = ShiftPaths(Data=loft, Offset=-1)
tree_statistics_2 = TreeStatistics(Tree=shift_paths_2)  # -> Paths, Length, Count
reverse_surface_direction = ReverseSurfaceDirection(Surface=shift_paths_2, ReverseOption="2")
flip_matrix_2 = FlipMatrix(Data=reverse_surface_direction)
reverse_surface_direction_2 = ReverseSurfaceDirection(Surface=flip_matrix_2, ReverseOption="2")
repeat_data = RepeatData(Data=merge, Length=tree_statistics_2.Count)  # -> simplify(Data)
sift_pattern = SiftPattern(List=reverse_surface_direction_2, SiftPattern=repeat_data)  # -> Output0, Output1
sift_pattern_2 = SiftPattern(List=flip_matrix_2, SiftPattern=repeat_data)  # -> Output0, Output1
combine_data = CombineData(Input0=sift_pattern.Output0, Input1=sift_pattern_2.Output1)  # -> Result, Index

tstat = TreeStatistics(Tree=combine_data.Result)  # -> Paths, Length, Count
division = Division(A=tstat.Count, B="4")
addition_2 = Addition(A="1", B=division)  # -> flatten(Result)
addition_3 = Addition(A=addition_2, B=division)  # -> flatten(Result)
addition_4 = Addition(A=addition_3, B=division)  # -> flatten(Result)
series_3 = Series(Start=["1", addition_2, addition_3, addition_4], Step=1, Count=10)  # -> flatten(Series)
item_2 = ListItem(List=tstat.Paths, Index=series_3, Wrap=True)
split = SplitTree(Data=combine_data.Result, Masks=flatten(item_2))  # -> Positive, Negative
srf = Surface(split.Positive)
tstat_2 = TreeStatistics(Tree=srf)  # -> Paths, Length, Count
series_4 = Series(Start="1", Step="2", Count="20")  # -> flatten(Series)
item_3 = ListItem(List=tstat_2.Paths, Index=series_4, Wrap=True)
srf_2 = Surface(split.Negative)
split_2 = SplitTree(Data=srf, Masks=flatten(item_3))  # -> Positive, Negative
revsrf = ReverseSurfaceDirection(Surface=split_2.Positive, ReverseOption="1")
merge_6 = Merge(Data1=revsrf, Data2=split_2.Negative)
merge_7 = Merge(Data1=merge_6, Data2=srf_2)
map_srf = MapToSurface(Curve=cluster_6.data_2, Source=cluster_6.data_4, Target=merge_7)

explode_6 = Explode(Curve=curve_19, Recursive=True)  # -> Segments, Vertices
explode_7 = Explode(Curve=curve_15, Recursive=True)  # -> reparameterize(Segments), Vertices
explode_8 = Explode(Curve=curve_20, Recursive=True)  # -> Segments, Vertices
divide_curve_7 = DivideCurve(Curve=explode_7.Segments, Count=nb_of_division_by_wall, Kinks=False)  # -> simplify(Points), Tangents, Parameters
curve_closest_point_3 = CurveClosestPoint(Point=divide_curve_7.Points, Curve=graft(explode_6.Segments))  # -> simplify(Point), Parameter, Distance
curve_closest_point_4 = CurveClosestPoint(Point=divide_curve_7.Points, Curve=graft(explode_8.Segments))  # -> simplify(Point), Parameter, Distance
line_4 = Line(StartPoint=curve_closest_point_3.Point, EndPoint=curve_closest_point_4.Point)
shift_paths_3 = ShiftPaths(Data=line_4, Offset=-1)
divide_curve_8 = DivideCurve(Curve=shift_paths_3, Count=nb_of_layers, Kinks=False)  # -> Points, Tangents, Parameters
shatter_3 = Shatter(Curve=graft(shift_paths_3), Parameters=divide_curve_8.Parameters)  # -> simplify(Segments)

# ---- group: Find corners
number_slider_13 = Slider(13, range=0..100)
series_5 = Series(Start=Slider(12, range=0..100), Step=number_slider_13, Count=10)
series_6 = Series(Start=0, Step=number_slider_13, Count=10)
tree_statistics_3 = TreeStatistics(Tree=shatter_3)  # -> Paths, Length, Count
list_item_9 = ListItem(List=tree_statistics_3.Paths, Index=[series_6, series_5], Wrap=True)

# ----
split_tree_2 = SplitTree(Data=shatter_3, Masks=flatten(list_item_9))  # -> Positive, Negative

# ---- group: Scale corner
curve_23 = Curve(split_tree_2.Positive)
end_points_3 = EndPoints(Curve=curve_23)  # -> Start, End
list_item_10 = ListItem(List=end_points_3.End, Index=0, Wrap=True)  # -> Item1, Item, Item1_2
point_3 = Point(list_item_10.Item1)
scale_2 = Scale(Geometry=curve_23, Center=point_3, Factor=Slider(1.1, range=0..10))  # -> Geometry, Transform

# ----
show = Show(G=mesh_uv)
surface = Surface(srf4pt)

bouncysolver = BouncySolver(
    GoalObjects=simplify([show, pshift, pshift_3, pshift_4]),
    Reset=Button(),
    Threshold=1e-15,
    Tolerance=0.0001,
    Damping=0.99,
    Iterations=10,
    On=Toggle(True))  # -> I, V, O
data_dam = DataDam(DataDataA=bouncysolver.O, BufferDelay=10000000, BufferMode=0)

mesh = Mesh(data_dam)
clean = CleanTree(RemoveNulls=Toggle(True), RemoveInvalid=True, RemoveEmpty=False, Tree=mesh)  # -> simplify(graft(Tree))
msh2psrf = MeshToPolysurface(Mesh=clean, Triangles=False, FaceMerge=False)  # -> simplify(Polysurface)

brep = Brep(msh2psrf)

# ---- group: Vault height
bounding_box_2 = BoundingBox(Content=msh2psrf, Plane=PlaneXY(0, 0, 0))  # -> Box, Box_2
surface_2 = Surface(surface)
find_top_face = FindTopFace(B=bounding_box_2.Box)
area = Area(Geometry=find_top_face)  # -> Area, Centroid
area_2 = Area(Geometry=surface_2)  # -> Area, Centroid
distance_2 = Distance(PointA=area.Centroid, PointB=area_2.Centroid)
panel_3 = Panel(distance_2)

# ----
number = Number(simplify(distance_2))
average = Average(Input=number)

data_dam_2 = DataDam(DataDataA=bouncysolver.O, BufferDelay=10000000, BufferMode=0)
mesh_2 = Mesh(data_dam_2)

crvprox = CurveProximity(CurveA=cat, CurveB=project.Geometry)  # -> PointA, PointB, Distance
pdecon_2 = Deconstruct(Point=crvprox.PointA)  # -> XComponent, YComponent, expr("round(x,2)", ZComponent)
height = Data(average)
subtraction = Subtraction(A=height, B=pdecon_2.ZComponent)
neg = Negative(Value=decimal_tolerance_2)
roundd = RoundToDecimalPlace(NumberX=subtraction, DecimalPlace=decimal_tolerance_2, RoundType=1)  # -> Rounded, Difference
_10º = PowerOf10(Value=neg)
python = GhPythonScript(x=loop_start.Data, y=_10º, z=roundd.Rounded)  # -> a, b
# ---------- python: Python ----------
if z==0:
    a="True"
    b=x
else:
    a="False"
    b=x+(z/2)
__author__ = "Adwait"
__version__ = "2020.09.28"

import rhinoscriptsyntax as rs
# ---------- end python ----------
loop_end = LoopEnd(port=loop_start.port, Exit=python.a, Data=python.b, TimeOutVal=0, pausedState=False, state="Constant output")

clean_2 = CombineClean(Meshes=mesh_2)
nakedvertices = NakedVertices(Mesh=mesh_2)  # -> ClothedIndex, NakedIndex, ClothedPts, NakedPts
nv_2 = NakedVertices(Mesh=mesh_2)  # -> ClothedIndex, NakedIndex, ClothedPts, NakedPts
combine_clean = CombineClean(Meshes=flatten(mesh_2))
point_4 = Point(flatten(nv_2.NakedPts))
nakedvertices_2 = NakedVertices(Mesh=combine_clean)  # -> ClothedIndex, NakedIndex, ClothedPts, NakedPts
nv_3 = NakedVertices(Mesh=clean_2)  # -> ClothedIndex, NakedIndex, ClothedPts, NakedPts

toelrance_display = Panel(_10º)
pt_c = Point(crvprox.PointA)
catenary_max_height = Panel(pdecon_2.ZComponent)

point_5 = Point(flatten(nv_3.NakedPts))

# ---- group: Mix material to mesh to form element
# Thickness
# In Cm ! And height = Print Width
panel_4 = Panel("Clayshell")
thickness_big_protoype = Slider(4.5, range=0..10)
thickness_small_protoype = Slider(0.45, range=0..1)
cross_section = CrossSectionKaramba3D(
    FamilyNameOfCrossSection="DefaultCroSec",
    ElementIdentifier=panel_4,
    Material=matprops,
    Height_cm=thickness_small_protoype,
    mode="Shell - Const")
mesh_to_shell_karamba3d = MeshToShellKaramba3D(Mesh=clean_2, Identifier=panel_4, CrossSection=cross_section, LimitDistance_m=0.005)  # -> Element, Points, Info

# ----
removeduplicatepts = RemoveDuplicatePts(Points=point_4, Tolerance=0.01)

# ---- group: Find supports
# Supports
# This is not 100% sure how clay is connected to the ground
data_3 = Data(mesh_to_shell_karamba3d.Points)
pdecon_3 = Deconstruct(Point=data_3)  # -> XComponent, YComponent, ZComponent
smaller = SmallerThan(FirstNumber=pdecon_3.ZComponent, SecondNumber=expr("x/2", 0))  # -> SmallerThan, OrEqualTo
cull = CullPattern(List=data_3, CullPattern=smaller.SmallerThan)
pt_4 = Point(cull)
remove_duplicate_points_karamba3d = RemoveDuplicatePointsKaramba3D(Point=point_5, LimitDistance=Slider(0.001, range=0..0.001))  # -> OutPoint, Info, Indexes
support_karamba3d = SupportKaramba3D(PosInd=removeduplicatepts, menu=[buttons(on, on, on, off, off, off)])

# ----
point_6 = Point(support_karamba3d)
assemble_model_karamba3d = AssembleModelKaramba3D(
    Elem=mesh_to_shell_karamba3d.Element,
    Support=support_karamba3d,
    Load=loads,
    LimitDistance_m=Slider(0.0001, range=0..0.0001))  # -> Model, Info, Mass_kg, CenterOfGravity, LoadCaseNames

# ---- group: Center of gravity
number_slider_14 = Slider(0.08, range=0..0.1)  # disabled
data_4 = Data(assemble_model_karamba3d.CenterOfGravity)  # disabled
swatch = ColourSwatch(SwatchColor=RGB(255, 255, 255))  # disabled
dots = DotDisplay(Point=data_4, Colour=swatch, Size=number_slider_14)  # disabled

# ----
mjoin = MeshJoin(Meshes=flatten(clean))  # disabled
clean_3 = CombineClean(Meshes=mjoin)  # disabled
unim = UnifyMesh(Mesh=clean_3)  # -> Result, Count; disabled
demesh = DeconstructMesh(Mesh=unim.Result)  # -> Vertices, Faces, Colours, Normals; disabled
devec = DeconstructVector(Vector=demesh.Normals)  # -> XComponent, YComponent, ZComponent; disabled
abs = Absolute(Value=devec.ZComponent)  # disabled
asin = ArcSine(Value=abs)  # disabled
deg = Degrees(Radians=asin)  # disabled
bounds = Bounds(Numbers=deg)  # disabled
dedomain = DeconstructDomain(Domain=bounds)  # -> Start, End; disabled
gradient = Gradient(
    LowerLimit=dedomain.Start,
    UpperLimit=dedomain.End,
    Parameter=deg,
    stops=[0.1: RGB(0, 128, 0), 0.5: RGB(255, 255, 0), 0.902: RGB(255, 0, 0)])  # disabled
max_inclination = Panel(dedomain.End)  # disabled
conmesh = ConstructMesh(Vertices=demesh.Vertices, Faces=demesh.Faces, Colours=gradient)  # disabled

# ----
# LENGHT ACCORDING TO INCLINATION
mjoin_2 = MeshJoin(Meshes=flatten(clean))  # disabled
clean_4 = CombineClean(Meshes=mjoin_2)  # disabled
unim_2 = UnifyMesh(Mesh=clean_4)  # -> Result, Count; disabled

merge_8 = Merge(Data1=scale_2.Geometry, Data2=split_tree_2.Negative)
flip_matrix_3 = FlipMatrix(Data=merge_8)

negative_5 = Negative(Value=toolpath_offset)
extend_curve_3 = ExtendCurve(Curve=flip_matrix_3, Type=0, Start=negative_5, End=negative_5)
curve_24 = Curve(extend_curve_3)

shift_list_2 = ShiftList(List=curve_24, Shift=1, Wrap=True)  # -> simplify(graft(List))
graft_tree_2 = GraftTree(Tree=curve_24, IncludeEmptyLists=True, IncludeNullItems=True)  # -> simplify(Tree)
loft_2 = Loft(
    Curves=[graft_tree_2, shift_list_2],
    Options={Adjust=False, Closed=False, LoftEnds=0, LoftSimp=0, LoftType=3, Rebuild=10, Refit=0.01})  # -> simplify(Loft)
shift_paths_4 = ShiftPaths(Data=loft_2, Offset=-1)
tree_statistics_4 = TreeStatistics(Tree=shift_paths_4)  # -> Paths, Length, Count
reverse_surface_direction_3 = ReverseSurfaceDirection(Surface=shift_paths_4, ReverseOption="2")
flip_matrix_4 = FlipMatrix(Data=reverse_surface_direction_3)
reverse_surface_direction_4 = ReverseSurfaceDirection(Surface=flip_matrix_4, ReverseOption="2")
repeat_data_2 = RepeatData(Data=merge, Length=tree_statistics_4.Count)  # -> simplify(Data)
sift_pattern_3 = SiftPattern(List=reverse_surface_direction_4, SiftPattern=repeat_data_2)  # -> Output0, Output1
sift_pattern_4 = SiftPattern(List=flip_matrix_4, SiftPattern=repeat_data_2)  # -> Output0, Output1
combine_data_2 = CombineData(Input0=sift_pattern_3.Output0, Input1=sift_pattern_4.Output1)  # -> Result, Index

tstat_3 = TreeStatistics(Tree=combine_data_2.Result)  # -> Paths, Length, Count
division_2 = Division(A=tstat_3.Count, B="4")
addition_5 = Addition(A="1", B=division_2)  # -> flatten(Result)
addition_6 = Addition(A=addition_5, B=division_2)  # -> flatten(Result)
addition_7 = Addition(A=addition_6, B=division_2)  # -> flatten(Result)
series_7 = Series(Start=["1", addition_5, addition_6, addition_7], Step=1, Count=10)  # -> flatten(Series)
item_4 = ListItem(List=tstat_3.Paths, Index=series_7, Wrap=True)
panel_5 = Panel(series_7)
split_3 = SplitTree(Data=combine_data_2.Result, Masks=flatten(item_4))  # -> Positive, Negative
srf_3 = Surface(split_3.Positive)
tstat_4 = TreeStatistics(Tree=srf_3)  # -> Paths, Length, Count
series_8 = Series(Start="1", Step="2", Count="20")  # -> flatten(Series)
item_5 = ListItem(List=tstat_4.Paths, Index=series_8, Wrap=True)
split_4 = SplitTree(Data=srf_3, Masks=flatten(item_5))  # -> Positive, Negative
revsrf_2 = ReverseSurfaceDirection(Surface=split_4.Positive, ReverseOption="1")
merge_9 = Merge(Data1=revsrf_2, Data2=split_4.Negative)
tstat_5 = TreeStatistics(Tree=merge_9)  # -> Paths, Length, Count
panel_6 = Panel("""true
true
false
false
true
true
false
false
true
true""")
dispatch = Dispatch(List=tstat_5.Paths, DispatchPattern=panel_6)  # -> ListA, ListB
split_5 = SplitTree(Data=merge_9, Masks=flatten(dispatch.ListA))  # -> Positive, Negative

srf_4 = Surface(split_3.Negative)

surface_3 = Surface(split_5.Negative)
list_item_11 = ListItem(List=surface_3, Index=0, Wrap=True)  # -> Item1, Item
md_slider_2 = MDSlider(
    SliderMode=0,
    slider_value=Point(0.2420803163, 0, 0.5),
    x_domain=Domain(0, 1),
    y_domain=Domain(0, 1),
    z_domain=Domain(0, 1))
evaluate_surface = EvaluateSurface(Surface=reparameterize(list_item_11.Item1), Point=md_slider_2)  # -> Point, Normal, UDirection, VDirection, Frame
scale_nu = ScaleNU(Geometry=list_item_11.Item1, Plane=evaluate_surface.Frame, ScaleX=1, ScaleY=Slider(1.9, range=0..10), ScaleZ=1)  # -> Geometry, Transform
list_length = ListLength(List=surface_3)  # -> expr("x-1", Length)
replace_items = ReplaceItems(List=surface_3, Item=scale_nu.Geometry, Indices=list_length, Wrap=False)
match_tree = MatchTree(Tree=replace_items, Guide=surface_3)

list_item_12 = ListItem(List=split_5.Positive, Index=0, Wrap=True)  # -> Item1, Item, Item1_2, Item2
evaluate_surface_2 = EvaluateSurface(Surface=reparameterize(list_item_12.Item1), Point="{0.5,0,0}")  # -> Point, Normal, UDirection, VDirection, Frame
scale_nu_2 = ScaleNU(Geometry=list_item_12.Item1, Plane=evaluate_surface_2.Frame, ScaleX=1, ScaleY=Slider(0.85, range=0..1), ScaleZ=1)  # -> Geometry, Transform
list_length_2 = ListLength(List=split_5.Positive)  # -> expr("x-1", Length)
replace_items_2 = ReplaceItems(List=split_5.Positive, Item=scale_nu_2.Geometry, Indices=list_length_2, Wrap=False)  # -> simplify(List)

map_srf_2 = MapToSurface(Curve=cluster_5.data_3, Source=cluster_5.data_4, Target=srf_4)
map_srf_3 = MapToSurface(Curve=cluster.data_4, Source=cluster.data_3, Target=split_5.Positive)
map_srf_4 = MapToSurface(Curve=cluster.data_4, Source=cluster.data_3, Target=split_5.Negative)
map_srf_5 = MapToSurface(Curve=cluster.data_4, Source=cluster.data_3, Target=split_5.Negative)
map_srf_6 = MapToSurface(Curve=cluster_2.data_3, Source=cluster_2.data_4, Target=split_5.Positive)
map_srf_7 = MapToSurface(Curve=cluster_3.data_3, Source=cluster_3.data_4, Target=replace_items_2)
map_srf_8 = MapToSurface(Curve=cluster_4.data_3, Source=cluster_4.data_4, Target=match_tree)
merge_10 = Merge(Data1=map_srf_3, Data2=map_srf_4)
merge_11 = Merge(Data1=map_srf_6, Data2=map_srf_5)
merge_12 = Merge(Data1=map_srf_7, Data2=simplify(map_srf_8))  # -> simplify(Result)
merge_13 = Merge(Data1=merge_10, Data2=map_srf_2)
merge_14 = Merge(Data1=merge_11, Data2=map_srf_2)
merge_15 = Merge(Data1=merge_12, Data2=simplify(map_srf_2))

# ---- group: TWEEN FOR LOFT
tweencrv = TweenCurve(CurveA=merge_13, CurveB=map_srf, Factor=Slider(0.8, range=0..1), BlendType=0)  # -> simplify(graft(Tween))
tweencrv_2 = TweenCurve(CurveA=merge_13, CurveB=map_srf, Factor=Slider(0.72, range=0..1), BlendType=0)  # -> simplify(graft(Tween))
tweencrv_3 = TweenCurve(CurveA=merge_14, CurveB=map_srf, Factor=Slider(0.52, range=0..1), BlendType=0)  # -> simplify(graft(Tween))
tweencrv_4 = TweenCurve(CurveA=merge_14, CurveB=map_srf, Factor=Slider(0.2, range=0..1), BlendType=0)  # -> simplify(graft(Tween))
crv_2 = Curve(simplify(graft(map_srf)))
crv_3 = Curve(graft(merge_15))

# ---- group: WALL
wall = Loft(
    Curves=[crv_3, tweencrv_4, tweencrv_3, tweencrv_2, tweencrv, crv_2],
    Options={Adjust=False, Closed=False, LoftEnds=0, LoftSimp=0, LoftType=1, Rebuild=10, Refit=0.01})
custom_preview = CustomPreview(
    Geometry=wall,
    Material={diffuse=RGB(221, 160, 221), emission=RGB(66, 48, 66), shine=0.5, specular=RGB(255, 255, 255), transparency=0})

# ----
brep_2 = Brep(flatten(wall))
unit_z = UnitZ(Factor=1)
contour = Contour(Shape=brep_2, Point=Point(0, 0, 0), Direction=unit_z, Distance=Slider(1.5, range=0..10))

length = Length(Curve=contour)
mass_addition = MassAddition(Input=flatten(length))  # -> Result, PartialResults

curve_25 = Curve(contour)

curve_26 = Curve(curve_25)
shift_paths_5 = ShiftPaths(Data=curve_26, Offset=-1)
join_curves_2 = JoinCurves(Curves=curve_25, Preserve=False)  # -> flatten(Curves)
join_curves_3 = JoinCurves(Curves=join_curves_2, Preserve=False)  # -> flatten(Curves)
length_2 = Length(Curve=join_curves_3)
list_item_13 = ListItem(List=join_curves_3, Index=0, Wrap=True)
smaller_than = SmallerThan(FirstNumber=length_2, SecondNumber=Slider(5, range=0..10))  # -> SmallerThan, OrEqualTo
cull_pattern_5 = CullPattern(List=join_curves_3, CullPattern=invert(smaller_than.SmallerThan))

# ---- group: GRAFT BY Z
curve_27 = Curve(flatten(cull_pattern_5))
curve_middle = CurveMiddle(Curve=curve_27)
deconstruct = Deconstruct(Point=curve_middle)  # -> XComponent, YComponent, ZComponent
graft_list_by_same_value = GraftListBySameValue(list=curve_27, number=flatten(deconstruct.ZComponent))
curve_28 = Curve(graft_list_by_same_value)
join_curves_4 = JoinCurves(Curves=curve_28, Preserve=False)

# ---- group: Rebuild => Line = BUG
curve_29 = Curve(join_curves_4)
curve_to_polyline = CurveToPolyline(Curve=curve_29, ToleranceDistance=0, ToleranceAngle=0, MinEdge=Slider(1, range=0..1), MaxEdge=Slider(1, range=0..10))  # -> simplify(Polyline), Segments
curve_30 = Curve(curve_to_polyline.Polyline)

# ---- group: Quick circular sorting
curve_31 = Curve(curve_30)
curve_middle_2 = CurveMiddle(Curve=curve_31)
circle_fit = CircleFit(Points=curve_middle_2)  # -> Circle, Radius, Deviation
sort_along_curve = SortAlongCurve(Points=curve_middle_2, Curve=circle_fit.Circle)  # -> Points, Indices
list_item_14 = ListItem(List=curve_31, Index=sort_along_curve.Indices, Wrap=True)
curve_32 = Curve(list_item_14)
flip_curve = FlipCurve(Curve=curve_32, Guide=circle_fit.Circle)  # -> Curve, Flag

# ----
shift_paths_6 = ShiftPaths(Data=crv_2, Offset=-1)

curve_33 = Curve(flip_curve.Curve)

curve_34 = Curve(shift_paths_6)
curve_35 = Curve(curve_34)
curve_36 = Curve(curve_33)

# ---- group: Toolpath order preview
curve_37 = Curve(flatten(curve_36))
list_length_3 = ListLength(List=flatten(curve_37))
range_3 = Range(Domain=Domain(0, 1), Steps=list_length_3)
gradient_2 = Gradient(
    LowerLimit=0,
    UpperLimit=1,
    Parameter=range_3,
    stops=[0: RGB(234, 38, 0), 0.25: RGB(234, 126, 0), 0.5: RGB(254, 244, 84), 0.75: RGB(173, 203, 249), 1: RGB(75, 107, 169)])
custom_preview_lineweights = CustomPreviewLineweights(Geometry=curve_37, Shader=gradient_2, Absolute=False)

# ---- group: Top infill
curve_38 = Curve(curve_34)

# ----
vaults_walls = BooleanToggle(True)
stream_filter = StreamFilter(Gate=vaults_walls, Stream1=curve_33)

# ---- group: Slice curve until it can't reach the required slicing proportions
unit_z_2 = UnitZ(Factor=1)
# ADAPTATIVE SLICING HEIGHTS
curve_39 = Curve(reparameterize(curve_9))
contour_2 = Contour(Curve=curve_39, Point=Point(0, 0, 0), Direction=unit_z_2, Distance=slicing_distance_min)  # -> Contours, simplify(Parameters)

# ----
shift_paths_7 = ShiftPaths(Data=contour_2.Contours, Offset=-1)
shift_paths_8 = ShiftPaths(Data=contour_2.Parameters, Offset=-1)

# ---- group: Slice curve until it can't reach the required slicing proportions (continued)
project_3 = Project(Geometry=shift_paths_7, Plane=PlaneXY(0, 0, 0))  # -> Geometry, Transform
shift_list_3 = ShiftList(List=project_3.Geometry, Shift=1, Wrap=invert(True))
distance_3 = Distance(PointA=project_3.Geometry, PointB=shift_list_3)
smaller_than_2 = SmallerThan(FirstNumber=distance_3, SecondNumber=distance_bewteen_layer_layer_thcikness_2)  # -> SmallerThan, OrEqualTo

# ----
insert_items = InsertItems(List=smaller_than_2.SmallerThan, Item="True", Indices=Slider(0, range=0..100), Wrap=True)

# ---- group: AnalyzeThII (Karamba3D)
analyzethii = AnalyzeThIIKaramba3D(Model=assemble_model_karamba3d.Model, RTolerance=1e-07, MaxIterations="10", NoTensionalNII=False)  # -> CalculatedModel, MaximumDisplacement_cm, ResultingForceOfGravity_kN, ElasticEnergy_kNm

# ----
max_displacement_cm = Panel(analyzethii.MaximumDisplacement_cm)
bmodes = BucklingModesKaramba3D(Model=analyzethii.CalculatedModel, FromIndex=1, NumberOfModes=1, MaximumNumberOfIterations=300, Epsilon=1e-07)  # -> ModelWithBucklingModesAsLoadCaseResults, BucklingLoadFactors
buckling = Panel(bmodes.BucklingLoadFactors)

model_view_karamba3d = ModelViewKaramba3D(Model=bmodes.ModelWithBucklingModesAsLoadCaseResults, ResultFactors=1, ResultCase=-1)  # -> Model, DeformedMesh, DeformedAxes, DeformedModel
model_view_karamba3d_2 = ModelViewKaramba3D(Model=bmodes.ModelWithBucklingModesAsLoadCaseResults, ResultFactors=1, ResultCase=-1)  # -> Model, DeformedMesh, DeformedAxes, DeformedModel
shell_view_karamba3d = ShellViewKaramba3D(Model=model_view_karamba3d.Model, IndexOfLayer=0)  # -> Model, MeshesOfRenderedShells, LegendColors, LegendTags
shell_view_karamba3d_2 = ShellViewKaramba3D(Model=model_view_karamba3d_2.Model, IndexOfLayer=0)  # -> Model, MeshesOfRenderedShells, LegendColors, LegendTags
data_5 = Data(model_view_karamba3d.DeformedMesh)
legend = Legend(Colour=shell_view_karamba3d.LegendColors, Tags=shell_view_karamba3d.LegendTags, LegendType=1)
legend_2 = Legend(Colour=shell_view_karamba3d_2.LegendColors, Tags=shell_view_karamba3d_2.LegendTags, LegendType=1)

# ---- group: Preview
mesh_3 = Mesh()  # disabled
mesh_4 = Mesh(shell_view_karamba3d_2.MeshesOfRenderedShells)  # disabled
mesh_5 = Mesh(shell_view_karamba3d.MeshesOfRenderedShells)  # disabled
medges = MeshEdges(Mesh=mesh_5)  # -> NakedEdges, InteriorEdges, NonManifoldEdges; disabled
medges_2 = MeshEdges(Mesh=mesh_3)  # -> NakedEdges, InteriorEdges, NonManifoldEdges; disabled
medges_3 = MeshEdges(Mesh=mesh_4)  # -> NakedEdges, InteriorEdges, NonManifoldEdges; disabled
brep_wireframe = BrepWireframe(Density=-1)  # disabled
colour_swatch = ColourSwatch(SwatchColor=RGB(166, 166, 166))  # disabled
colour_swatch_2 = ColourSwatch(SwatchColor=RGB(219, 219, 219))  # disabled
colour_swatch_3 = ColourSwatch(SwatchColor=RGB(219, 219, 219))  # disabled
curve_40 = Curve([medges_2.NakedEdges, medges_2.InteriorEdges, medges_2.NonManifoldEdges])  # disabled
curve_41 = Curve([medges_3.NakedEdges, medges_3.InteriorEdges, medges_3.NonManifoldEdges])  # disabled
curve_42 = Curve([medges.NakedEdges, medges.InteriorEdges, medges.NonManifoldEdges])  # disabled
custom_preview_lineweights_2 = CustomPreviewLineweights(Geometry=curve_42, Shader=colour_swatch_2, Absolute=False)  # disabled
custom_preview_lineweights_3 = CustomPreviewLineweights(Geometry=brep_wireframe, Shader=colour_swatch_3, Absolute=False)  # disabled
custom_preview_lineweights_4 = CustomPreviewLineweights(
    Geometry=mesh_4,
    Shader={diffuse=RGB(255, 105, 180), emission=RGB(76, 32, 54), shine=0.5, specular=RGB(255, 255, 255), transparency=0},
    Absolute=False)  # disabled
custom_preview_lineweights_5 = CustomPreviewLineweights(Geometry=curve_41, Shader=colour_swatch, Absolute=False)  # disabled

# ----
custom_preview_lineweights_6 = CustomPreviewLineweights(Geometry=mesh_5, Shader=colour_swatch_2, Absolute=False)  # disabled

# ---- group: Slice curve until it can't reach the required slicing proportions (continued)
cull_pattern_6 = CullPattern(List=shift_paths_7, CullPattern=insert_items)
cull_pattern_7 = CullPattern(List=shift_paths_8, CullPattern=insert_items)
list_item_15 = ListItem(List=cull_pattern_7, Index="-1", Wrap=True)
shatter_4 = Shatter(Curve=curve_39, Parameters=list_item_15)
list_item_16 = ListItem(List=shatter_4, Index=0, Wrap=True)  # -> Item, Item1
curve_43 = Curve(reparameterize(list_item_16.Item1))
point_7 = Point(simplify(cull_pattern_6))
curve_44 = Curve(list_item_16.Item)

# ----
flip_curve_2 = FlipCurve(Curve=curve_44)  # -> Curve, Flag

# ---- group: Slice curve until it can't reach the required slicing proportions
divide_distance = DivideDistance(Curve=flip_curve_2.Curve, Distance=distance_bewteen_layer_layer_thcikness_2)  # -> Points, Tangents, Parameters
evaluate_curve = EvaluateCurve(Curve=reparameterize(flip_curve_2.Curve), Parameter="0.995")  # -> simplify(Point), Tangent, Angle

# ----
cull_index = CullIndex(List=divide_distance.Points, Indices="0", Wrap=True)  # -> simplify(List)
merge_16 = Merge(Data1=point_7, Data2=cull_index, Data3=evaluate_curve.Point)

# ---- group: Slice curve until it can't reach the required slicing proportions (continued)
entwine = Entwine(Branch0X=point_7, Branch1X=cull_index, FlattenInputs=False)
point_8 = Point(merge_16)

# ----
deconstruct_2 = Deconstruct(Point=point_8)  # -> XComponent, YComponent, ZComponent
sort_list = SortList(Keys=deconstruct_2.ZComponent)  # -> Keys, ValuesValuesA
entwine_2 = Entwine(Branch0X=sort_list.Keys, Branch1X=surface, FlattenInputs=False)
data_dam_3 = DataDam(DataDataA=entwine_2, BufferDelay=10000000, BufferMode=0)
split_tree_3 = SplitTree(Data=data_dam_3, Masks=flatten("{0;*}"))  # -> Positive, Negative

surface_4 = Surface(split_tree_3.Negative)

# ---- group: Slicer
# SLICER
data_6 = Data(split_tree_3.Positive)

# ---- group: Slicer / Check difference with levels
sort_list_2 = SortList(Keys=data_6)  # -> Keys, ValuesValuesA
shift_list_4 = ShiftList(List=sort_list_2.Keys, Shift=1, Wrap=invert(True))
subtraction_2 = Subtraction(A=shift_list_4, B=sort_list_2.Keys)
panel_7 = Panel(subtraction_2)

# ---- group: Slicer / Tolreance
addition_8 = Addition(A=data_6, B="0.1")

# ---- group: Slicer / array of surfaces
amp_2 = Amplitude(Vector=evalsrf.Normal, Amplitude=addition_8)
move_2 = Move(Geometry=surface_4, Motion=amp_2)  # -> simplify(Geometry), Transform

# ---- group: Slicer
bbx = BrepBrep(BrepA=move_2.Geometry, BrepB=msh2psrf)  # -> Curves, Points
pshift_5 = ShiftPaths(Data=bbx.Curves, Offset=-1)
sort_crv = SortDuplicateCurves(Curves=pshift_5)  # -> UniqueCurves, Indices
flip_matrix_5 = FlipMatrix(Data=sort_crv.UniqueCurves)

curve_45 = Curve(flip_matrix_5)

# ---- group: Reset infill according to the walls / Boudary curves
curve_46 = Curve(sort_crv.UniqueCurves)
curve_47 = Curve(surface)
edges = BrepEdges(Brep=curve_47)  # -> Naked, Interior, NonManifold
crv_4 = Curve(edges.Naked)

# ---- group: Reset infill according to the walls
# INFILL PLACEMENT
number_of_ribs_for_the_inside_vaults = Slider(5, range=0..10)
curve_48 = Curve(curve_46)

# ---- group: Reset infill according to the walls / Find connect and unconnected curves to the walls
curve_middle_3 = CurveMiddle(Curve=crv_4)
bounding_box_3 = BoundingBox(Content=flatten(crv_4), Plane=PlaneXY(0, 0, 0), UnionBox=True)  # -> Box, Box_2
brep_closest_point = BrepClosestPoint(Point=curve_middle_3, Brep=bounding_box_3.Box)  # -> Point, Normal, Distance
smaller_than_3 = SmallerThan(FirstNumber=brep_closest_point.Distance, SecondNumber="1")  # -> SmallerThan, OrEqualTo
sift_pattern_5 = SiftPattern(List=simplify(graft(crv_4)), SiftPattern=graft(smaller_than_3.SmallerThan))  # -> Output0, Output1
curve_49 = Curve(simplify(sift_pattern_5.Output0))
curve_50 = Curve(simplify(sift_pattern_5.Output1))

# ---- group: Vault over Wall Divison
curve_middle_4 = CurveMiddle(Curve=curve_35)
list_item_17 = ListItem(List=curve_middle_4, Index=0, Wrap=True)  # -> Item1, Item
polyline = PolyLine(Vertices=[list_item_17.Item1, list_item_17.Item], Closed=False)
curve_51 = Curve(polyline)
project_4 = Project(Geometry=curve_50, Plane=PlaneXY(0, 0, 0))  # -> Geometry, Transform
project_5 = Project(Geometry=curve_51, Plane=PlaneXY(0, 0, 0))  # -> Geometry, Transform
curve_curve = CurveCurve(CurveA=reparameterize(project_4.Geometry), CurveB=reparameterize(flatten(project_5.Geometry)))  # -> Points, ParamsA, ParamsB
shift_paths_9 = ShiftPaths(Data=curve_curve.ParamsA, Offset=-1)
evaluate_curve_2 = EvaluateCurve(Curve=reparameterize(curve_50), Parameter=shift_paths_9)  # -> Point, Tangent, Angle
point_9 = Point(list_item_17.Item)

curve_middle_5 = CurveMiddle(Curve=curve_51)

# ---- group: Vault over Rope Division
divide_curve_9 = DivideCurve(Curve=curve_49, Count=number_of_ribs_for_the_inside_vaults, Kinks=False)  # -> Points, Tangents, Parameters

# ---- group: Reset infill according to the walls / Divide each section accordingliy
merge_17 = Merge(Data1=simplify(divide_curve_9.Points), Data2=simplify(evaluate_curve_2.Point))
shift_paths_10 = ShiftPaths(Data=merge_17, Offset=-1)

# ----
cull_duplicates_2 = CullDuplicates(Points=shift_paths_10, Tolerance=0.1, CullMode=3)  # -> Points, Indices, Valence

# ---- group: Tope "Infill"
curve_52 = Curve(curve_47)
project_6 = Project(Geometry=curve_52, Plane=PlaneXY(0, 0, 0))  # -> flatten(Geometry), Transform
rope_width = Slider(3, range=0..10)
curve_53 = Curve()
negative_6 = Negative(Value=rope_width)
offset_curve_2 = OffsetCurve(Curve=project_6.Geometry, Distance=negative_6, Corners=1)  # -> flatten(Curve)

# ---- group: Reset infill according to the walls / Extrude Brep for slicing
center_2 = Center(Geometric=curve_48)  # -> Center, Dimension
list_item_18 = ListItem(List=center_2.Center, Index=0, Wrap=True)
line_5 = Line(StartPoint=cull_duplicates_2.Points, EndPoint=list_item_18)
amp_3 = Amplitude(Vector=evalsrf.Normal, Amplitude=Slider(100, range=0..100))
extr = Extrude(Base=line_5, Direction=amp_3)  # -> simplify(Extrusion)

# ---- group: Reset infill according to the walls / Extrude Brep for slicing / Sort planes by circles
area_3 = Area(Geometry=extr)  # -> Area, Centroid
sort_point_by_circle = SortPointByCircle(P=area_3.Centroid)  # -> P_2, I
list_item_19 = ListItem(List=extr, Index=sort_point_by_circle.I, Wrap=True)

# ---- group: Reset infill according to the walls / Extrude Brep for slicing (continued)
move_3 = Move(Geometry=list_item_19, Motion=expr("-x/2", amp_3))  # -> Geometry, Transform

# ---- group: Reset infill according to the walls / Intersect
curve_54 = Curve(curve_48)
cross_reference = CrossReference(ListListA=move_3.Geometry, ListListB=curve_54, CrossMode=1)  # -> ListListA, ListListB
brep_curve = BrepCurve(Brep=cross_reference.ListListA, Curve=cross_reference.ListListB)  # -> Curves, simplify(Points)

# ---- group: Reset infill according to the walls / Create infill guidelines
curve_55 = Curve(curve_54)
shift_paths_11 = ShiftPaths(Data=brep_curve.Points, Offset=-1)
list_length_4 = ListLength(List=move_3.Geometry)
center_3 = Center(Geometric=curve_55)  # -> Center, Dimension
partition_list = PartitionList(List=shift_paths_11, Size=list_length_4)
polyline_2 = PolyLine(Vertices=partition_list, Closed=invert(False))  # disabled
line_6 = Line(StartPoint=graft(center_3.Center), EndPoint=partition_list)

# ----
line_7 = Line(line_6)
# CURVATURE OVERALL SHAPE
end_points_4 = EndPoints(Curve=line_7)  # -> Start, End
line_sdl_2 = LineSDL(Start=end_points_4.End, Direction=line_7, Length=1)  # -> graft(Line)
path_mapper = PathMapper(line_sdl_2, source="{A;B;C}", target="{A;C;B}")
# REMAP ORIENTATION OF THE VAULT RIBS
shift_paths_12 = ShiftPaths(Data=path_mapper, Offset=-1)
# Remap Inside vaults Lenght
end_points_5 = EndPoints(Curve=shift_paths_12)  # -> Start, End

project_7 = Project(Geometry=shift_paths_12, Plane=PlaneXY(0, 0, 0))  # -> Geometry, Transform
curve_56 = Curve(reparameterize(curve_47))
list_item_20 = ListItem(List=project_7.Geometry, Index=0, Wrap=True)
shift_paths_13 = ShiftPaths(Data=list_item_20, Offset=-1)
project_8 = Project(Geometry=curve_56, Plane=PlaneXY(0, 0, 0))  # -> Geometry, Transform
extend_curve_4 = ExtendCurve(Curve=shift_paths_13, Type=0, Start="10", End="10")  # -> reparameterize(Curve)
curve_curve_2 = CurveCurve(CurveA=extend_curve_4, CurveB=reparameterize(project_8.Geometry))  # -> Points, ParamsA, ParamsB
offset_curve_3 = OffsetCurve(Curve=reparameterize(project_8.Geometry), Distance="-1", Corners=1)
shift_paths_14 = ShiftPaths(Data=curve_curve_2.Points, Offset=-1)
cull_duplicates_3 = CullDuplicates(Points=shift_paths_14, Tolerance=0.1, CullMode=3)  # -> Points, Indices, Valence
curve_closest_point_5 = CurveClosestPoint(Point=shift_paths_14, Curve=offset_curve_3)  # -> Point, Parameter, Distance
line_8 = Line(StartPoint=curve_closest_point_5.Point, EndPoint=cull_duplicates_3.Points)

list_indices = ListIndices(List=shift_paths_12)
construct_domain_2 = ConstructDomain(DomainStart=number_slider_8, DomainEnd=number_slider_9)
bounds_2 = Bounds(Numbers=flatten(list_indices))
remap_numbers = RemapNumbers(Value=list_indices, Source=bounds_2, Target=Domain(0, 1))  # -> Mapped, Clipped
graph_mapper = GraphMapper(
    remap_numbers.Mapped,
    x0=0,
    x1=1,
    y0=0,
    y1=1,
    container_name="Bezier",
    cpx=[0, 0.6867429614, 0.2969355583, 1],
    cpy=[1, 0, 0, 1])
remap_numbers_2 = RemapNumbers(Value=graph_mapper, Source=Domain(0, 1), Target=construct_domain_2)  # -> Mapped, Clipped

end_points_6 = EndPoints(Curve=shift_paths_12)  # -> Start, End; disabled
number_slider_15 = Slider(1, range=0..1)  # disabled
mesh_closest_point = MeshClosestPoint(Point=end_points_6.End, Mesh=unim_2.Result)  # -> Point, Index, Parameter; disabled
mesh_eval = MeshEval(Mesh=unim_2.Result, Parameter=mesh_closest_point.Parameter)  # -> Point, Normal, Colour; disabled
line_sdl_3 = LineSDL(Start=mesh_closest_point.Point, Direction=mesh_eval.Normal, Length=number_slider_15)  # disabled

devec_2 = DeconstructVector(Vector=line_sdl_3)  # -> XComponent, YComponent, ZComponent; disabled
abs_2 = Absolute(Value=devec_2.ZComponent)  # disabled
asin_2 = ArcSine(Value=abs_2)  # disabled
deg_2 = Degrees(Radians=asin_2)  # disabled
construct_domain_3 = ConstructDomain(DomainStart=number_slider_8, DomainEnd=1)  # disabled
bounds_3 = Bounds(Numbers=flatten(deg_2))  # disabled
remap_numbers_3 = RemapNumbers(Value=deg_2, Source=bounds_3, Target=construct_domain_3)  # -> Mapped, Clipped; disabled

vector = Vector(path_mapper)

# ---- group: Remap vectors
curve_57 = Curve(shift_paths_13)
curve_58 = Curve(line_8)
vector_2 = Vector(unitize(graft(curve_57)))
vector_3 = Vector(unitize(graft(curve_58)))
deconstruct_vector = DeconstructVector(Vector=vector_2)  # -> XComponent, YComponent, ZComponent
deconstruct_vector_2 = DeconstructVector(Vector=vector_3)  # -> XComponent, YComponent, ZComponent
list_length_5 = ListLength(List=project_7.Geometry)  # -> expr("x-1", Length)
construct_domain_4 = ConstructDomain(DomainStart=deconstruct_vector.XComponent, DomainEnd=deconstruct_vector_2.XComponent)
construct_domain_5 = ConstructDomain(DomainStart=deconstruct_vector.YComponent, DomainEnd=deconstruct_vector_2.YComponent)
construct_domain_6 = ConstructDomain(DomainStart=deconstruct_vector.ZComponent, DomainEnd=deconstruct_vector_2.ZComponent)
range_4 = Range(Domain=construct_domain_4, Steps=list_length_5)
range_5 = Range(Domain=construct_domain_5, Steps=list_length_5)
range_6 = Range(Domain=construct_domain_6, Steps=list_length_5)
vector_xyz = VectorXYZ(XComponent=range_4, YComponent=range_5, ZComponent=range_6)  # -> Vector, Length
line_sdl_4 = LineSDL(Start=graft(curve_closest_point_5.Point), Direction=vector_xyz.Vector, Length=1)  # -> reverse(Line)

# ----
panel_8 = Panel(vector)

line_sdl_5 = LineSDL(Start=end_points_5.End, Direction=line_sdl_4, Length=simplify(remap_numbers_2.Mapped))  # -> simplify(graft(Line))
curve_59 = Curve(line_sdl_5)

curve_60 = Curve(curve_59)

shift_paths_15 = ShiftPaths(Data=curve_60, Offset=-1)
list_item_21 = ListItem(List=shift_paths_15, Index=0, Wrap=True)
project_9 = Project(Geometry=curve_38, Plane=PlaneXY(0, 0, 0))  # -> flatten(Geometry), Transform
project_10 = Project(Geometry=list_item_21, Plane=PlaneXY(0, 0, 0))  # -> Geometry, Transform
join_curves_5 = JoinCurves(Curves=project_9.Geometry, Preserve=False)
curve_line = CurveLine(Curve=flatten([join_curves_5, offset_curve_2]), Line=project_10.Geometry)  # -> Points, Params, Count
shift_paths_16 = ShiftPaths(Data=curve_line.Points, Offset=-1)

end_points_7 = EndPoints(Curve=curve_60)  # -> Start, End

closest_points_2 = ClosestPoints(Point=end_points_7.End, Cloud=flatten(point), Count="1")  # -> simplify(ClosestPoint), CPIndex, simplify(Distance)
larger_than = LargerThan(FirstNumber=simplify(closest_points_2.Distance), SecondNumber=distance_selection_threshold)  # -> LargerThan, OrEqualTo
sift_pattern_6 = SiftPattern(List=closest_points_2.Distance, SiftPattern=larger_than.LargerThan)  # -> Output0, Output1
multiplication = Multiplication(A=sift_pattern_6.Output1, B="0")

# ---- group: Sort and extnd for interesection
extend_curve_5 = ExtendCurve(Curve=project_10.Geometry, Type=0, Start="1000", End="1000")
sort_along_curve_2 = SortAlongCurve(Points=shift_paths_16, Curve=extend_curve_5)  # -> Points, Indices

# ---- group: Inside curves adjusment
bounds_4 = Bounds(Numbers=flatten(sift_pattern_6.Output0))
remap_numbers_4 = RemapNumbers(Value=sift_pattern_6.Output0, Source=bounds_4, Target=Domain(0, 1))  # -> Mapped, Clipped
graph_mapper_2 = GraphMapper(
    remap_numbers_4.Mapped,
    x0=0,
    x1=1,
    y0=0,
    y1=1,
    container_name="Bezier",
    cpx=[0, 0.4800902307, 0.2789486349, 1],
    cpy=[0, 0.980461657, 0.9600971341, 0])
remap_numbers_5 = RemapNumbers(Value=graph_mapper_2, Source=Domain(0, 1), Target=extend_in_intersections)  # -> Mapped, Clipped

# ----
list_length_6 = ListLength(List=shift_paths_15)  # -> expr("x-1", Length)
range_7 = Range(Domain=Domain(0, 1), Steps=list_length_6)  # -> simplify(Range)

combine_data_3 = CombineData(Input0=remap_numbers_5.Mapped, Input1=multiplication)  # -> Result, Index

# ---- group: Regroup and sort
extend_curve_6 = ExtendCurve(Curve=curve_60, Type=0, Start="0.1", End=combine_data_3.Result)

# ---- group: Sort intersection events
curve_middle_6 = CurveMiddle(Curve=project_10.Geometry)
distance_4 = Distance(PointA=sort_along_curve_2.Points, PointB=curve_middle_6)
smaller_than_4 = SmallerThan(FirstNumber=distance_4, SecondNumber=Slider(40, range=0..100))  # -> SmallerThan, OrEqualTo
cull_pattern_8 = CullPattern(List=sort_along_curve_2.Points, CullPattern=smaller_than_4.SmallerThan)  # -> simplify(List)

list_item_22 = ListItem(List=cull_pattern_8, Index=0, Wrap=True)  # -> Item1, Item
point_10 = Point(list_item_22.Item1)
point_11 = Point(list_item_22.Item)
line_9 = Line(StartPoint=point_10, EndPoint=point_11)
sort_along_curve_3 = SortAlongCurve(Points=cull_pattern_8, Curve=line_9)  # -> Points, Indices

list_item_23 = ListItem(List=sort_along_curve_3.Points, Index=0, Wrap=True)  # -> Item1, Item
point_12 = Point(list_item_23.Item1)
point_13 = Point(list_item_23.Item)

# ---- group: Redraw lines
end_points_8 = EndPoints(Curve=project_10.Geometry)  # -> Start, End

line_10 = Line(StartPoint=end_points_8.End, EndPoint=point_13)
line_11 = Line(StartPoint=end_points_8.Start, EndPoint=point_12)

length_3 = Length(Curve=line_10)
length_4 = Length(Curve=line_11)

# ---- group: Adjust according to height
number_slider_16 = Slider(1, range=0..10)
construct_domain_7 = ConstructDomain(DomainStart=length_3, DomainEnd=number_slider_16)
construct_domain_8 = ConstructDomain(DomainStart=length_4, DomainEnd=number_slider_16)
graph_mapper_3 = GraphMapper(range_7, x0=0, x1=1, y0=0, y1=1, container_name="Bezier", cpx=[0, 0.2569580078, 0.5049133301, 1], cpy=[0, 1, 1, 1])
remap_numbers_6 = RemapNumbers(Value=graph_mapper_3, Source=Domain(0, 1), Target=construct_domain_8)  # -> Mapped, Clipped
remap_numbers_7 = RemapNumbers(Value=graph_mapper_3, Source=Domain(0, 1), Target=construct_domain_7)  # -> Mapped, Clipped
number_slider_17 = Slider(0, range=0..100)
extend_curve_7 = ExtendCurve(Curve=curve_60, Type=0, Start=graft(remap_numbers_6.Mapped), End=graft(remap_numbers_7.Mapped))

# ---- group: Regroup and sort
null_item = NullItem(Item=extend_curve_7)  # -> NullFlags, InvalidFlags, Description
sift_pattern_7 = SiftPattern(List=extend_curve_6, SiftPattern=null_item.NullFlags)  # -> Output0, Output1
sift_pattern_8 = SiftPattern(List=extend_curve_7, SiftPattern=null_item.NullFlags)  # -> Output0, Output1
combine_data_4 = CombineData(Input0=sift_pattern_7.Output1, Input1=sift_pattern_8.Output0)  # -> Result, Index

curve_61 = Curve(simplify(combine_data_4.Result))

# ---- group: Regroup and sort / Sort by levels
path_mapper_2 = PathMapper(curve_61, source="{A;B;C}", target="{A;C;B}")
shift_paths_17 = ShiftPaths(Data=path_mapper_2, Offset=-1)

# ---- group: Regroup and sort (continued)
curve_62 = Curve(reparameterize(shift_paths_17))

# ----
# INFILL PLACEMENT
curve_63 = Curve(reparameterize(curve_62))

# ---- group: Divide and alternate pattern
divide_curve_10 = DivideCurve(Curve=curve_63, Count="2", Kinks=False)  # -> Points, Tangents, Parameters

shatter_5 = Shatter(Curve=graft(curve_63), Parameters=division_position_parameter)  # -> simplify(Segments)
sift_pattern_9 = SiftPattern(List=reverse(shatter_5), SiftPattern=[0, 1, 0, 1])  # -> Output0, Output1
flip_curve_3 = FlipCurve(Curve=sift_pattern_9.Output0)  # -> Curve, Flag
combine_data_5 = CombineData(Input0=flip_curve_3.Curve, Input1=sift_pattern_9.Output1)  # -> simplify(Result), Index

# ---- group: Separate
number_slider_18 = Slider(0, range=0..100)
extend_curve_8 = ExtendCurve(Curve=combine_data_5.Result, Type=0, Start=number_slider_18, End=number_slider_18)  # -> simplify(Curve)

# ---- group: Reorganise for loft / Clean the mess
clean_tree = CleanTree(RemoveNulls=True, RemoveInvalid=True, RemoveEmpty=invert(False), Tree=extend_curve_8)  # -> graft(Tree)

# ----
path_mapper_3 = PathMapper(clean_tree, source="{A;B;C;D}", target="{A;D;B;C}")

# ---- group: Reorganise for loft
shift_paths_18 = ShiftPaths(Data=path_mapper_3, Offset=-1)
shift_list_5 = ShiftList(List=shift_paths_18, Shift=1, Wrap=True)
graft_tree_3 = GraftTree(Tree=shift_paths_18, IncludeEmptyLists=True, IncludeNullItems=True)  # -> simplify(Tree)
graft_tree_4 = GraftTree(Tree=shift_list_5, IncludeEmptyLists=True, IncludeNullItems=True)  # -> simplify(Tree)
curve_64 = Curve([graft_tree_3, graft_tree_4])
end_points_9 = EndPoints(Curve=curve_64)  # -> Start, reverse(End)
merge_18 = Merge(Data1=end_points_9.Start, Data2=end_points_9.End)
polyline_3 = PolyLine(Vertices=merge_18, Closed=invert(False))

# ---- group: Apply infill
map_to_surface = MapToSurface(Curve=data, Source=data_2, Target=polyline_3)  # -> simplify(Curve)
shift_paths_19 = ShiftPaths(Data=map_to_surface, Offset=-1)
join_curves_6 = JoinCurves(Curves=shift_paths_19, Preserve=False)

# ---- group: regraft by levels
shift_paths_20 = ShiftPaths(Data=join_curves_6, Offset=-1)
path_mapper_4 = PathMapper(shift_paths_20, source="{A;B;C}", target="{A;C;B}")
shift_paths_21 = ShiftPaths(Data=path_mapper_4, Offset=-1)

# ---- group: replace FIX
# GCODE PROCESSING
number_slider_19 = Slider(0, range=0..10)
vector_xyz_2 = VectorXYZ(XComponent=number_slider_19, YComponent=number_slider_19, ZComponent=0)  # -> Vector, Length
move_4 = Move(Geometry=shift_paths_21, Motion=vector_xyz_2.Vector)  # -> Geometry, Transform
move_z_5 = MoveZ(G=move_4.Geometry, F=".7")
curve_65 = Curve(move_z_5)

# ---- group: Random seam
curve_66 = Curve(reparameterize(curve_65))
lng = ListLength(List=curve_66)
random = Random(Number=lng, seed=1214693, rMode=0)
seam = Seam(Curve=reparameterize(curve_66), Seam=random)
end = EndPoints(Curve=seam)  # -> Start, End
curve_67 = Curve(reparameterize(seam))

# ---- group: Organize for printing
curve_68 = Curve(simplify(graft(curve_67)))
path_mapper_5 = PathMapper(curve_68, source="{A;B;C}", target="{B;C;A}")
shift_paths_22 = ShiftPaths(Data=path_mapper_5, Offset=-1)
shift_paths_23 = ShiftPaths(Data=shift_paths_22, Offset=-1)

# ---- group: Select
panel_9 = Panel("{1;*;*}")  # disabled
split_tree_4 = SplitTree(Data=curve_68, Masks=flatten(panel_9))  # -> Positive, Negative; disabled

# ----
curve_69 = Curve(shift_paths_23)
curve_70 = Curve(curve_69)

# ---- group: Lenght adaptative division
# Variable infill numbers
length_5 = Length(Curve=curve_63)  # disabled
number_slider_20 = Slider(5, range=0..10)  # disabled

average_2 = Average(Input=length_5)  # disabled
panel_10 = Panel("2")  # disabled
number_slider_21 = Slider(2, range=0..10)  # disabled
number_slider_22 = Slider(0, range=0..100)  # disabled

division_3 = Division(A=average_2, B=number_slider_20)  # disabled
round = Round(Number=division_3)  # -> Nearest, Floor, Ceiling; disabled
panel_11 = Panel(round.Ceiling)  # disabled

# ---- group: Lenght adaptative division / 1 or 3
odd_even_numbers = OddEvenNumbers(Numbers=round.Ceiling, Placeholders=False)  # -> Odd, Even; disabled
multiplication_2 = Multiplication(A=odd_even_numbers.Even, B=number_slider_21)  # disabled
replace_items_3 = ReplaceItems(List=odd_even_numbers.Even, Item=multiplication_2, Indices=number_slider_22, Wrap=False)  # disabled

# ---- group: Lenght adaptative division (continued)
round_to_factor = RoundToFactor(NumberX=round.Ceiling, Factor=panel_10, RoundType=0)  # -> Rounded, Difference, MultiplierR, MultiplierX; disabled

# ----
brep_3 = Brep(<brep referenced from the Rhino model>)
cartesian_printer_measure_x = Slider(235, range=0..1000)
cartesian_printer_measure_y = Slider(235, range=0..1000)
cartesian_printer_height_z = Slider(300, range=0..1000)
delta_printer_diameter = Slider(220, range=0..1000)
delta_printer_height_z = Slider(290, range=0..1000)
curve_71 = Curve(curve_70)
# HEADER: ;HEADER
# ;Start_gcode
# G21                     ; Set to metric [change to G20 if you want Imperial]
# G90                     ; Force coordinates to be absolute relative to the origin
# G28                     ; Home X/Y/Z axis
# M302 P1			; Disable Cold Extrusion Checking
# G92 E0                  ; Reset extruder to [0] zero end of cleaning run
# T0
# M117 Printing...
# ;ENDHEADER
header = Panel(""";HEADER
;Start_gcode
G21                     ; Set to metric [change to G20 if you want Imperial]
G90                     ; Force coordinates to be absolute relative to the origin
G28                     ; Home X/Y/Z axis
M302 P1			; Disable Cold Extrusion Checking
G92 E0                  ; Reset extruder to [0] zero end of cleaning run
T0
M117 Printing...
G1 Z150 F1500
G1 X100 Y100 F1500
;ENDHEADER""")
footer = Panel(""";FOOTER
; end_gcode
G91                             ; relative positioning
M107                            ; turn off layer fan				
G90                             ; absolute positioning
;ENDFOOTER
G0 Z150""")
delta_printer = BooleanToggle(False)
cluster_8 = Cluster(
    geometry_2=graft(brep_3),
    printer_measure_x=cartesian_printer_measure_x,
    printer_measure_y=cartesian_printer_measure_y,
    printer_height_z=cartesian_printer_height_z,
    delta_printer_measure_diameter=delta_printer_diameter,
    L=delta_printer_height_z,
    delta_printer=delta_printer)  # -> centered_geometry_4, printer_geometry_2, log_file_2
geo = Geometry(cluster_8.printer_geometry_2)
panel_12 = Panel(cluster_8.log_file_2)
cluster_9 = Cluster_3(
    slicing_distance=slicing_distance,
    noozle_diameter=noozle_diameter,
    z_height_offset=z_bed_height_offset,
    tolerance_resolution=tolerance_resolution,
    tolerance_resolution_2=Slider(1, range=0..10))  # -> sliced_geometry_3, settings_flow_2
group = Group()
number_slider_23 = Slider(10, range=0..10)
number_slider_24 = Slider(40, range=0..100)

vector_xyz_3 = VectorXYZ(XComponent=Slider(10, range=0..1000), YComponent=negative, ZComponent=0)  # -> Vector, Length
first_layer_offset = Panel("1")
move_5 = Move(Geometry=curve_71, Motion=vector_xyz_3.Vector)  # -> Geometry, Transform
move_z_6 = MoveZ(G=move_5.Geometry, F=first_layer_offset)

move_6 = Move(Motion=vector_xyz_3.Vector)  # -> Geometry, Transform
move_7 = Move(Geometry=curve_71, Motion=vector_xyz_3.Vector)  # -> Geometry, Transform

# ---- group: Preview
curve_72 = Curve(move_z_6)
data_dam_4 = DataDam(DataDataA=curve_72, BufferDelay=10000000, BufferMode=0)
unit_z_3 = UnitZ(Factor=Slider(1.5, range=0..10))
negative_7 = Negative(Value=unit_z_3)
number_slider_25 = Slider(2.25, range=0..10)
extrude = Extrude(Base=data_dam_4, Direction=negative_7)
negative_8 = Negative(Value=number_slider_25)
mesh_6 = Mesh(extrude)
offset_mesh = OffsetMesh(Mesh=mesh_6, Distance=number_slider_25, BothSides=negative_8, CreateSolid=True)
custom_preview_2 = CustomPreview(Geometry=offset_mesh, Material=ColourSwatch(SwatchColor=RGB(255, 255, 255)))

# ---- group: Random seam
curve_73 = Curve(reparameterize(move_z_6))
lng_2 = ListLength(List=curve_73)
random_2 = Random(Number=lng_2, seed=7479218, rMode=0)
seam_2 = Seam(Curve=reparameterize(curve_73), Seam=random_2)
end_2 = EndPoints(Curve=seam_2)  # -> Start, End
curve_74 = Curve(reparameterize(seam_2))

# ---- group: Preview Displacement
curve_75 = Curve(curve_74)
number_slider_26 = Slider(5, range=0..100)
end_points_10 = EndPoints(Curve=curve_75)  # -> Start, flatten(End)
shift_list_6 = ShiftList(List=end_points_10.End, Shift=1, Wrap=True)  # -> simplify(graft(List))
move_z_7 = MoveZ(G=shift_list_6, F=number_slider_26)  # -> simplify(G_2)
graft_tree_5 = GraftTree(Tree=end_points_10.End, IncludeEmptyLists=True, IncludeNullItems=True)  # -> simplify(Tree)
move_z_8 = MoveZ(G=graft_tree_5, F=number_slider_26)  # -> simplify(G_2)
merge_19 = Merge(Data1=graft_tree_5, Data2=move_z_8, Data3=move_z_7, Data4=shift_list_6)
polyline_4 = PolyLine(Vertices=merge_19, Closed=False)
custom_preview_lineweights_7 = CustomPreviewLineweights(Geometry=polyline_4, Shader=ColourSwatch(SwatchColor=RGB(86, 222, 240)), Absolute=False)
curve_76 = Curve(polyline_4)

# ----
length_6 = Length(Curve=curve_76)

# ---- group: CONFIG FOR KOSSEL CLAY PRINTING
cluster_10 = Cluster_4(custom_start_gcode=header, custom_endgcode=footer)

# ----
mass_addition_2 = MassAddition(Input=flatten(length_6))  # -> Result, PartialResults
panel_13 = Panel(mass_addition_2.Result)
point_14 = Point(end_2.End)

# ---- group: Approach cuvre
curve_77 = Curve(curve_74)
center_4 = Center(Geometric=curve_77)  # -> Center, Dimension
extend_curve_9 = ExtendCurve(Curve=curve_77, Type=0, Start="-0.2", End="-0.2")
end_points_11 = EndPoints(Curve=extend_curve_9)  # -> Start, End
line_12 = Line(StartPoint=end_points_11.End, EndPoint=center_4.Center)
line_sdl_6 = LineSDL(Start=end_points_11.End, Direction=line_12, Length="1")
line_sdl_7 = LineSDL(Start=end_points_11.Start, Direction=line_12, Length="1")
join_curves_7 = JoinCurves(Curves=[extend_curve_9, line_sdl_6, line_sdl_7], Preserve=False)
curve_78 = Curve(join_curves_7)

# ----
curve_to_polyline_2 = CurveToPolyline(Curve=curve_78, ToleranceDistance=0, ToleranceAngle=0, MaxEdge=Slider(1, range=0..1))  # -> Polyline, Segments

data_dam_5 = DataDam(DataDataA=curve_to_polyline_2.Polyline, BufferDelay=10000000, BufferMode=0)
length_7 = Length(Curve=flatten(curve_to_polyline_2.Polyline))
discontinuity_3 = Discontinuity(Curve=data_dam_5, Level=1)  # -> Points, Parameters
mass_addition_3 = MassAddition(Input=length_7)  # -> Result, PartialResults

cluster_11 = Cluster_2(
    settings_flow=cluster_9.settings_flow_2,
    sliced_geometry=data_dam_5,
    jog_speed_f_mm_s=jog_speed_f_mm_s,
    print_speed_f_mm_s=print_speed_f_mm_s,
    extruding_speed_e=extruding_multiplier_e,
    stepback_retraction_setting=stepsbackairtravelling,
    start_endgcode=cluster_10,
    extrusion_wait=number_slider_11,
    F=Slider(20, range=0..100),
    pressure_control=toggle)  # -> g_code_output_2, total_print_lenght_2, total_print_volume_2, total_print_time_2
panel_14 = Panel(cluster_11.total_print_time_2)
panel_15 = Panel(cluster_11.total_print_lenght_2)
panel_16 = Panel(cluster_11.total_print_volume_2)
panel_17 = Panel(cluster_11.g_code_output_2)

panel_18 = Panel(mass_addition_3.Result)
extend_curve_10 = ExtendCurve(Curve=curve_77, Type=0, Start=Slider(0, range=0..100), End=Slider(1, range=0..10))

# ==== cluster MoveZ
F = ClusterInput()
G = ClusterInput()
Z = UnitZ(Factor=F)
move = Move(Geometry=G, Motion=Z)  # -> Geometry, Transform
G_2 = ClusterOutput(move.Geometry)

# ==== cluster CenteredRectangle
P = ClusterInput()
A = ClusterInput()
A_2 = ClusterInput()
dom = ConstructDomain(DomainStart=expr("x/2", A), DomainEnd=expr("-x/2", A))
dom_2 = ConstructDomain(DomainStart=expr("x/2", A_2), DomainEnd=expr("-x/2", A_2))
rectangle = Rectangle(Plane=P, XSize=dom, YSize=dom_2, Radius=0)  # -> Rectangle, Length
R = ClusterOutput(rectangle.Rectangle)

# ==== cluster Cluster
delta_printer_measure_diameter = ClusterInput()
L = ClusterInput()
delta_printer = ClusterInput()
geometry = ClusterInput()
geometry_2 = ClusterInput()
printer_measure_x = ClusterInput()
printer_measure_y = ClusterInput()
printer_height_z = ClusterInput()
delta_printer_measure_diameter_2 = Number(delta_printer_measure_diameter)
delta_printer_2 = Boolean(delta_printer)
geometry_3 = Geometry(geometry)
geometry_4 = Geometry(geometry_2)
printer_measure_x_2 = Number(printer_measure_x)
printer_measure_y_2 = Number(printer_measure_y)
printer_height_z_2 = Number(printer_height_z)
brep = Brep(geometry_4)
expression = Expression(x=printer_measure_y_2, Expression="x/2")
expression_2 = Expression(x=printer_measure_x_2, Expression="x/2")
expression_3 = Expression(x=printer_height_z_2, Expression="x/2")
delta_printer_3 = Boolean(delta_printer_2)
expression_4 = Expression(x=delta_printer_measure_diameter_2, Expression="x/2")
pt = ConstructPoint(XCoordinate=expression_2, YCoordinate=expression, PrinterHeightZ=expression_3)
cyl = Cylinder(Base=PlaneXY(0, 0, 0), Radius=expression_4, Length=L)
box = CenterBox(Base=pt, PrinterMeasureX=expression_2, PrinterMeasureY=expression, PrinterHeightZ=expression_3)
debrep = DeconstructBrep(Brep=cyl)  # -> Faces, Edges, Vertices
geometry_5 = Geometry(geometry_3)
geometry_6 = Geometry(brep)
item = ListItem(List=debrep.Edges, Index=Slider(3, range=0..10), Wrap=True)
edges = BrepEdges(Brep=cyl)  # -> Naked, Interior, NonManifold
bbox = BoundingBox(Content=flatten(geometry_5), Plane=PlaneXY(0, 0, 0), UnionBox=True)  # -> Box, Box_2
edges_2 = BrepEdges(Brep=box)  # -> Naked, Interior, NonManifold
bbox_2 = BoundingBox(Content=flatten(geometry_6), Plane=PlaneXY(0, 0, 0), UnionBox=True)  # -> Box, Box_2
area = Area(Geometry=item)  # -> Area, Centroid
boundary = BoundarySurfaces(Edges=item)
box_2 = EvaluateBox(Box=bbox.Box, UParameter=0.5, VParameter=0.5, WParameter=0)  # -> Plane, Point, Include
box_3 = EvaluateBox(Box=bbox_2.Box, UParameter=0.5, VParameter=0.5, WParameter=0)  # -> Plane, Point, Include
item_2 = ListItem(List=edges.Naked, Index=Slider(1, range=0..10), Wrap=True)
debrep_2 = DeconstructBrep(Brep=box)  # -> Faces, Edges, Vertices
merge = Merge(Data1=item_2, Data2=boundary)
item_3 = ListItem(List=debrep_2.Faces, Index=Slider(4, range=0..10), Wrap=True)
area_2 = Area(Geometry=item_3)  # -> Area, Centroid
filter = StreamFilter(Gate=delta_printer_3, Stream0=area_2.Centroid, Stream1=area.Centroid)
filter_2 = StreamFilter(Gate=delta_printer_3, Stream0=area_2.Centroid, Stream1=area.Centroid)
vec2pt = Vector2Pt(PointA=box_2.Point, PointB=filter, Unitize=False)  # -> Vector, Length
vec2pt_2 = Vector2Pt(PointA=box_3.Point, PointB=filter_2, Unitize=False)  # -> Vector, Length
move = Move(Geometry=geometry_5, Motion=vec2pt.Vector)  # -> Geometry, Transform
move_2 = Move(Geometry=geometry_6, Motion=vec2pt_2.Vector)  # -> Geometry, Transform
merge_2 = Merge(Data1=edges_2.Interior, Data2=item_3)
geo = Geometry(merge)
geo_2 = Geometry(merge_2)
filter_3 = StreamFilter(Gate=delta_printer_3, Stream0=geo_2, Stream1=geo)
debox = DeconstructBox(Box=[bbox_2.Box, bbox.Box])  # -> Plane, X, Y, Z
null = NullItem(Item=geometry_5)  # -> NullFlags, InvalidFlags, Description
null_2 = NullItem(Item=geometry_6)  # -> NullFlags, InvalidFlags, Description
bnd = Bounds(Numbers=debox.Z)
bnd_2 = Bounds(Numbers=debox.X)
bnd_3 = Bounds(Numbers=debox.Y)
ma = MassAddition(Input=flatten([null.NullFlags, null_2.NullFlags]))  # -> Result, PartialResults
filter_4 = StreamFilter(Gate=delta_printer_3, Stream0=box, Stream1=cyl)
debrep_3 = DeconstructBrep(Brep=move_2.Geometry)  # -> Faces, Edges, Vertices
centered_geometry = Geometry(move.Geometry)
centered_geometry_2 = Geometry(move_2.Geometry)
dedomain = DeconstructDomain(Domain=bnd)  # -> Start, End
dedomain_2 = DeconstructDomain(Domain=bnd_2)  # -> Start, End
dedomain_3 = DeconstructDomain(Domain=bnd_3)  # -> Start, End
eval = EvaluateCurve(Curve=reparameterize(debrep_3.Edges), Parameter="0.5")  # -> flatten(Point), Tangent, Angle
cap = CapHoles(Brep=filter_4)
equals = Equality(FirstNumber=ma.Result, SecondNumber="0")  # -> Equality, Inequality
pt_2 = ConstructPoint(XCoordinate=dedomain_2.Start, YCoordinate=dedomain_3.Start, ZCoordinate=dedomain.Start)
ma_2 = MassMultiplication(Input=[null.NullFlags, null_2.NullFlags])  # -> Result, PartialResults
expression_5 = Expression(P=pt_2, Expression="Format(\"Print Size X{0:0.00}mm Y{1:0.00}mm Z{2:0.00}mm\", P.x, P.y, P.z)")
brepinc = PointInBrep(Brep=cap, Point=eval.Point, Strict=False)
equals_2 = Equality(FirstNumber=brepinc, SecondNumber="1")  # -> Equality, Inequality
ma_3 = MassMultiplication(Input=brepinc)  # -> Result, PartialResults
ma_4 = MassAddition(Input=equals_2.Inequality)  # -> Result, PartialResults
filter_5 = StreamFilter(Gate=null.NullFlags, Stream0="Your print is a Mesh", Stream1="Your print is a Brep")
filter_6 = StreamFilter(Gate=ma_2.Result, Stream0="Your print is a Brep and a Mesh")
filter_7 = StreamFilter(Gate=equals.Equality, Stream1="Please connect only Brep or Mesh.Not both")
panel = Panel(ma_4.Result)
filter_8 = StreamFilter(Gate=ma_2.Result, Stream1=filter_5)
equals_3 = Equality(FirstNumber=ma_4.Result, SecondNumber="0")  # -> Equality, Inequality
null_3 = NullItem(Item=equals_3.Inequality)  # -> NullFlags, InvalidFlags, Description
merge_3 = Merge(Data1=filter_8, Data2=filter_6)
panel_2 = Panel(equals_3.Inequality)
filter_9 = StreamFilter(
    Gate=equals_3.Inequality,
    Stream0=ColourSwatch(SwatchColor=RGBA(0, 155, 186, 142)),
    Stream1=ColourSwatch(SwatchColor=RGBA(255, 0, 0, 142)))
filter_10 = StreamFilter(Gate=equals_3.Inequality, Stream0=centered_geometry_2)
filter_11 = StreamFilter(Gate=null_3.NullFlags, Stream1=centered_geometry)
filter_12 = StreamFilter(Gate=equals.Equality, Stream0=expression_5)
merge_4 = Merge(Data1=filter_10, Data2=filter_11)
null_4 = NullItem(Item=merge_4)  # -> NullFlags, InvalidFlags, Description
filter_13 = StreamFilter(Gate=null_4.NullFlags, Stream0="No errors,you are good to go", Stream1="Geometry is out of bounds")
filter_14 = StreamFilter(Gate=equals.Equality, Stream0=filter_13, Stream1="Fatal Error")
merge_5 = Merge(Data1=filter_7, Data2=filter_14, Data3=merge_3, Data4=filter_12)
log_file = Data(merge_5)
panel_3 = Panel(log_file)
preview = CustomPreview(Geometry=filter_3, Shader=filter_9)
centered_geometry_3 = Geometry(merge_4)
panel_4 = Panel(centered_geometry_3)
log_file_2 = ClusterOutput(log_file)
printer_geometry = Geometry(filter_3)
printer_geometry_2 = ClusterOutput(printer_geometry)
centered_geometry_4 = ClusterOutput(centered_geometry_3)
preview_2 = CustomPreview(Geometry=centered_geometry_3, Shader=ColourSwatch(SwatchColor=RGBA(227, 227, 227, 145)))

# ==== cluster Cluster_2
F = ClusterInput()
pressure_control = ClusterInput()
settings_flow = ClusterInput()
sliced_geometry = ClusterInput()
jog_speed_f_mm_s = ClusterInput()
print_speed_f_mm_s = ClusterInput()
extruding_speed_e = ClusterInput()
stepback_retraction_setting = ClusterInput()
start_endgcode = ClusterInput()
extrusion_wait = ClusterInput()
settings_flow_2 = Data(settings_flow)
jog_speed_f_mm_s_2 = Number(jog_speed_f_mm_s)
print_speed_f_mm_s_2 = Number(print_speed_f_mm_s)
extruding_speed_e_2 = Number(extruding_speed_e)
stepback_retraction_setting_2 = Number(stepback_retraction_setting)
start_endgcode_2 = Data(start_endgcode)
bang = ExplodeTree(Data=start_endgcode_2)  # -> flatten(Branch0), flatten(Branch1)
sliced_geometry_2 = Geometry(sliced_geometry)

# ---- group: statisitics
item = ListItem(List=settings_flow_2, Index="2", Wrap=True)
noozle_diameter = Number(item)
item_2 = ListItem(List=settings_flow_2, Index="1", Wrap=True)
expression = Expression(x=item_2, Expression="x/4")
len = Length(Curve=flatten(sliced_geometry_2))
ma = MassAddition(Input=len)  # -> Result, PartialResults
rectangle = Rectangle(Plane=PlaneXY(0, 0, 0), XSize=item_2, YSize=noozle_diameter, Radius=expression)  # -> Rectangle, Length
expression_2 = Expression(x=ma.Result, y=print_speed_f_mm_s_2, Expression="(x/y)+(x/y)*0.25")
area = Area(Geometry=rectangle.Rectangle)  # -> Area, Centroid
concat = Concatenate(FragmentA=ma.Result, FragmentB=" mm")
expression_3 = Expression(x=ma.Result, y=area.Area, Expression="(x*y)/1000000")
concat_2 = Concatenate(FragmentA=expression_2, FragmentB=" minutes")
concat_3 = Concatenate(FragmentA=expression_3, FragmentB=" liters")

# ----
g_code_header = Text(bang.Branch0)
g_code_footer = Text(bang.Branch1)
explode = Explode(SlicedGeometry=sliced_geometry_2, Recursive=True)  # -> Segments, Vertices
pt = Point(explode.Vertices)
prune = PruneTree(Tree=pt, Minimum="1", Maximum=0)

# ---- group: E value calculation
shift = ShiftList(List=prune, Shift=1, Wrap=Toggle(True))
dist = Distance(PointA=prune, PointB=shift)
cull_i = CullIndex(List=dist, Indices="-1", Wrap=True)
expression_4 = Expression(x=cull_i, y=extruding_speed_e_2, Expression="x*y")
ma_2 = MassAddition(Input=flatten(expression_4))  # -> Result, PartialResults
lng = ListLength(List=expression_4)  # -> flatten(Length)
partition = PartitionList(List=ma_2.PartialResults, Size=lng)

# ----
cull_i_2 = CullIndex(List=prune, Indices="0", Wrap=True)
item_3 = ListItem(List=prune, Index="0", Wrap=True)
tstat = TreeStatistics(Tree=prune)  # -> Paths, Length, Count
lng_2 = ListLength(List=prune)
trim = TrimTree(Tree=cull_i_2, Depth=1)
item_4 = ListItem(List=tstat.Length, Index=0, Wrap=True)
equals = Equality(FirstNumber=lng_2, SecondNumber=item_4)  # -> Equality, Inequality
ma_3 = MassAddition(Input=flatten(equals.Equality))  # -> Result, PartialResults
match = MatchTree(Tree=partition, Guide=prune)
equals_2 = Equality(FirstNumber=tstat.Count, SecondNumber=ma_3.Result)  # -> Equality, Inequality
gate = StreamGate(Stream=prune, Gate=equals_2.Equality)  # -> Target0, Target1

# ---- group: retraction calculation
item_5 = ListItem(List=match, Index="-1", Wrap=True)
tolerance_resolution = Number(stepback_retraction_setting_2)
expression_5 = Expression(x=item_5, y=tolerance_resolution, Expression="x-y")
flatten = FlattenTree(Tree=expression_5, Path="{0}")
ins = InsertItems(List=flatten, Item="0", Indices="0", Wrap=True)  # -> flatten(List)

# ----
trim_2 = TrimTree(Tree=gate.Target0, Depth=1)
tstat_2 = TreeStatistics(Tree=gate.Target1)  # -> Paths, Length, Count
tstat_3 = TreeStatistics(Tree=trim_2)  # -> Paths, Length, Count
series = Series(Start="1", Step=1, Count=tstat_2.Count)  # -> graft(Series)
pt_2 = Point(trim)
series_2 = Series(Start="1", Step=1, Count=tstat_3.Count)  # -> graft(Series)
panel = Panel("""-1
-2
-3""")
pt_3 = Point(item_3)
num = Number(match)
match_2 = MatchTree(Tree=series_2, Guide=trim_2)
match_3 = MatchTree(Tree=series, Guide=gate.Target1)
item_6 = ListItem(List=pt_2, Index="-1", Wrap=True)
item_7 = ListItem(List=pt_2, Index="-3", Wrap=True)
item_8 = ListItem(List=pt_2, Index=panel, Wrap=True)
item_9 = ListItem(List=pt_2, Index="-1", Wrap=True)
Z = UnitZ(Factor=F)
graft = GraftTree(Tree=match_2, IncludeEmptyLists=True, IncludeNullItems=True)
graft_2 = GraftTree(Tree=match_3, IncludeEmptyLists=True, IncludeNullItems=True)
filter = StreamFilter(Gate=pressure_control, Stream0=item_6, Stream1=item_7)
filter_2 = StreamFilter(Gate=pressure_control, Stream0=item_9, Stream1=item_8)
merge = Merge(Data1=graft_2, Data2=graft)
move = Move(Geometry=pt_3, Motion=Z)  # -> Geometry, Transform
move_2 = Move(Geometry=filter, Motion=Z)  # -> Geometry, Transform
graft_3 = GraftTree(Tree=ins, IncludeEmptyLists=True, IncludeNullItems=True)
int = Integer(merge)
pshift = ShiftPaths(Data=graft_3, Offset="1")
panel_2 = Panel("""200
500
500
200""")

# ---- group: saftey movements
merge_2 = Merge(Data1=filter_2, Data2=move_2.Geometry)
merge_3 = Merge(Data1=move.Geometry, Data2=pt_3)

# ----
expression_6 = Expression(
    P=pt_2,
    PrintSpeedF=print_speed_f_mm_s_2,
    Extrusion=num,
    Expression="Format(\"G1 X{0:0.00} Y{1:0.00} Z{2:0.00} F{3,0} E{4:0.00}\", P.x, P.y, P.z, PrintSpeedF, Extrusion)")
filter_3 = StreamFilter(Gate=pressure_control, Stream0=jog_speed_f_mm_s_2, Stream1=panel_2)
expression_7 = Expression(
    P=pt_2,
    PrintSpeedF=print_speed_f_mm_s_2,
    Expression="Format(\"G1 X{0:0.00} Y{1:0.00} Z{2:0.00} F{3,0}\", P.x, P.y, P.z, PrintSpeedF)")
expression_8 = Expression(
    P=merge_3,
    JogSpeedF=jog_speed_f_mm_s_2,
    Expression="Format(\"G0 X{0:0.00} Y{1:0.00} Z{2:0.00} F{3,0} \", P.x, P.y, P.z, JogSpeedF)")
expression_9 = Expression(
    P=merge_2,
    JogSpeedF=filter_3,
    Expression="Format(\"G0 X{0:0.00} Y{1:0.00} Z{2:0.00} F{3,0} \", P.x, P.y, P.z, JogSpeedF)")

# ---- group: retraction
expression_10 = Expression(
    PointsDataMatch=pt_3,
    PrintSpeedF=print_speed_f_mm_s_2,
    back=pshift,
    Expression="Format(\"G1 F{0,0} E{1:0.00}\", PrintSpeedF, back)")

# ----
gate_2 = StreamGate(Stream=expression_10, Gate=pressure_control)  # -> Target0, Target1

panel_3 = Panel("""M106 P0 S255
M107""")
filter_4 = StreamFilter(Gate=pressure_control, Stream0=expression_6, Stream1=expression_7)
panel_4 = Panel("""0
-1""")
ins_2 = InsertItems(List=filter_4, Item=panel_3, Indices=panel_4, Wrap=True)
concat_4 = Concatenate(FragmentA="G4 ", FragmentB="P", FragmentC=extrusion_wait)
panel_5 = Panel("""1
-1""")
ins_3 = InsertItems(List=ins_2, Item=concat_4, Indices=panel_5, Wrap=True)
panel_6 = Panel("""0
-3""")
ins_4 = InsertItems(List=ins_3, Item="M400", Indices=panel_6, Wrap=True)
trim_3 = TrimTree(Tree=ins_4, Depth="3")
filter_5 = StreamFilter(Gate=pressure_control, Stream0=filter_4, Stream1=trim_3)

merge_4 = Merge(Data1=gate_2.Target0, Data2=expression_8, Data3=filter_5, Data4=expression_9)
trim_4 = TrimTree(Tree=merge_4, Depth=1)
expression_11 = Expression(n=int, Expression="Format(\";Layer # {0}\", n)")
tstat_4 = TreeStatistics(Tree=trim_4)  # -> Paths, Length, Count
series_3 = Series(Start=0, Step=1, Count=tstat_4.Count)  # -> graft(Series)
tstat_5 = TreeStatistics(Tree=series_3)  # -> Paths, Length, Count
replace = ReplacePaths(Data=series_3, Search=tstat_5.Paths, Replace=tstat_4.Paths)
expression_12 = Expression(n=replace, Expression="Format(\";Layer # {0}\", n)")
merge_5 = Merge(
    Data1=simplify(expression_11),
    Data2=simplify(gate_2.Target0),
    Data3=simplify(expression_8),
    Data4=simplify(filter_5),
    Data5=simplify(expression_9))
entwine = Entwine(Branch00=g_code_header, Branch01=merge_5, Branch02=g_code_footer, FlattenInputs=True)  # -> flatten(Result)
merge_6 = Merge(Data1=expression_12, Data2=trim_4)
entwine_2 = Entwine(Branch00=g_code_header, Branch01=merge_6, Branch02=g_code_footer, FlattenInputs=True)  # -> flatten(Result)
g_code_output = Text(entwine_2)
total_print_lenght = Text(concat)
total_print_volume = Text(concat_3)
total_print_time = Text(concat_2)
g_code_output_2 = ClusterOutput(g_code_output)
total_print_lenght_2 = ClusterOutput(total_print_lenght)
total_print_volume_2 = ClusterOutput(total_print_volume)
total_print_time_2 = ClusterOutput(total_print_time)
panel_7 = Panel(entwine_2)

# ==== cluster Cluster_3
tolerance_resolution = ClusterInput()
tolerance_resolution_2 = ClusterInput()
noozle_diameter = ClusterInput()
z_height_offset = ClusterInput()
slicing_distance = ClusterInput()
geometry = ClusterInput()
tolerance_resolution_3 = Number(tolerance_resolution)
tolerance_resolution_4 = Number(tolerance_resolution_2)
noozle_diameter_2 = Number(noozle_diameter)
slicing_distance_2 = Number(slicing_distance)
z_height_offset_2 = Number(z_height_offset)
addition = Addition(A=z_height_offset_2, B=slicing_distance_2)
geometry_2 = Geometry(geometry)
Z = UnitZ(Factor=addition)
move = Move(Geometry=geometry_2, Motion=Z)  # -> Geometry, Transform
geometry_input = Geometry(move.Geometry)
contour = Contour(Shape=geometry_input, Point=Point(0, 0, 0), Direction=Vector(0, 0, 1), Distance=slicing_distance_2)
lng = ListLength(List=flatten(geometry_input))
equals = Equality(FirstNumber=lng, SecondNumber="1")  # -> Equality, Inequality
sliced_geometry = Curve(contour)
topoly = CurveToPolyline(Curve=sliced_geometry, ToleranceDistance=tolerance_resolution_3, ToleranceAngle=0, MaxEdge=tolerance_resolution_4)  # -> Polyline, Segments
merge = Merge(Data1=equals.Inequality, Data2=slicing_distance_2, Data3=noozle_diameter_2)
flatten = FlattenTree(Tree=topoly.Polyline, Path="{0}")
center = Center(Geometry=flatten)  # -> Center, Dimension
expression = Expression(x=center.Center, Expression="x.z")
sort = SortList(Keys=expression, ValuesA=flatten)  # -> Keys, ValuesA
cset = CreateSet(List=sort.Keys)  # -> Set, Map
num = Number(cset.Set)
num_2 = Number(sort.Keys)
mindex = MemberIndex(Set=num_2, Member=num)  # -> Index, Count
pshift = ShiftPaths(Data=mindex.Index, Offset=1)
item = ListItem(List=sort.ValuesA, Index=pshift, Wrap=True)
center_2 = Center(Geometry=item)  # -> Center, Dimension
avr = Average(Input=center_2.Center)
cir = Circle(Plane=avr, Radius=1)
alongcrv = SortAlongCurve(Points=center_2.Center, Curve=cir)  # -> Points, Indices
trim = TrimTree(Tree=alongcrv.Indices, Depth=1)
item_2 = ListItem(List=item, Index=trim, Wrap=True)
tstat = TreeStatistics(Tree=item_2)  # -> Paths, Length, Count
dispatch = Dispatch(List=tstat.Paths, DispatchPattern=[True, False])  # -> ListA, ListB
branch = TreeBranch(Tree=item_2, Path=dispatch.ListA, MaintainPaths=True)
branch_2 = TreeBranch(Tree=item_2, Path=dispatch.ListB, MaintainPaths=True)
settings_flow = Data(merge)
settings_flow_2 = ClusterOutput(settings_flow)
rev = ReverseList(List=branch_2)
merge_2 = Merge(Data1=branch, Data2=rev)
sliced_geometry_2 = Geometry(merge_2)
sliced_geometry_3 = ClusterOutput(sliced_geometry_2)

# ==== cluster Cluster_4
data = Data()
custom_start_gcode = ClusterInput()
custom_endgcode = ClusterInput()
merge = Merge(Data1=data)
custom_start_gcode_2 = Data(custom_start_gcode)
custom_endgcode_2 = Data(custom_endgcode)
merge_2 = Merge(Data1=custom_start_gcode_2, Data2=custom_endgcode_2)  # -> graft(Result)
data_2 = Data(merge)
null = NullItem(Item=data_2)  # -> NullFlags, InvalidFlags, Description
ma = MassMultiplication(Input=null.NullFlags)  # -> Result, PartialResults
filter = StreamFilter(Gate=ma.Result, Stream0=merge, Stream1=merge_2)
start_endgcode = Data(filter)
start_endgcode_2 = ClusterOutput(start_endgcode)

# ==== cluster GraftListBySameValue
number = ClusterInput()
number_2 = Number(number)
list = ClusterInput()

# ---- group: Groupe by layers using sets
create_set = CreateSet(List=number_2)  # -> Set, Map
sort_list = SortList(Keys=create_set.Set)  # -> Keys, ValuesValuesA
member_index = MemberIndex(Set=number_2, Member=sort_list.Keys)  # -> Index, Count
list_item = ListItem(List=list, Index=member_index.Index, Wrap=True)
group = Group(Objects=list_item)  # -> flatten(Group)

# ---- group: Sorted by layer
ungroup = Ungroup(Group=graft(group))  # -> simplify(Objects)

# ----
objects = ClusterOutput(ungroup)

# ==== cluster FindTopFace
B = ClusterInput()
debrep = DeconstructBrep(Brep=B)  # -> Faces, Edges, Vertices
area = Area(Geometry=debrep.Faces)  # -> Area, Centroid
pdecon = Deconstruct(Point=area.Centroid)  # -> XComponent, YComponent, ZComponent
lowest_item = LowestItem(K=pdecon.ZComponent, A=debrep.Faces)
i = ClusterOutput(lowest_item)

# ==== cluster Cluster_5
control_perodic_crv_num_connections = ClusterInput()
control_perodic_crv_num_picks = ClusterInput()
division = Division(A=Slider(500, range=0..1000), B="6")
control_perodic_crv_num_connections_2 = Number(control_perodic_crv_num_connections)
rectangle = Rectangle(Plane=PlaneXY(0, 0, 0), XSize="333.333", YSize=division, Radius=0)  # -> Rectangle, Length
control_perodic_crv_num_picks_2 = Number(control_perodic_crv_num_picks)
long = LongestList(ListA=rectangle.Rectangle, ListB=control_perodic_crv_num_connections_2, PaddingMode=2)  # -> ListA, ListB
explode = Explode(Curve=long.ListA, Recursive=True)  # -> Segments, Vertices
item = ListItem(List=explode.Segments, Index=0, Wrap=True)  # -> Item, Item1, Item2
expression = Expression(x=long.ListB, Expression="1-x")
expression_2 = Expression(x=control_perodic_crv_num_picks_2, Expression="0.5+x")
expression_3 = Expression(x=control_perodic_crv_num_picks_2, Expression="0.5-x")
flip = FlipCurve(Curve=item.Item2)  # -> Curve, Flag
long_2 = LongestList(ListA="0", ListB=control_perodic_crv_num_connections_2, ListC=expression, ListD="1", PaddingMode=2)  # -> ListA, ListB, ListC, ListD
long_3 = LongestList(ListA=expression_2, ListB=".5", ListC=expression_3, PaddingMode=2)  # -> ListA, ListB, ListC
merge = Merge(Data1=graft(long_2.ListA), Data2=graft(long_2.ListB), Data3=graft(long_2.ListC), Data4=graft(long_2.ListD))
merge_2 = Merge(Data1=graft(long_3.ListC), Data2=graft(long_3.ListB), Data3=graft(long_3.ListA))

# ---- group: bottom
eval = EvaluateCurve(Curve=reparameterize(item.Item), Parameter=merge)  # -> Point, Tangent, Angle

# ---- group: top
eval_2 = EvaluateCurve(Curve=reparameterize(flip.Curve), Parameter=merge_2)  # -> Point, Tangent, Angle

# ----
panel = Panel(merge_2)
item_2 = ListItem(List=eval.Point, Index=0, Wrap=True)  # -> Item, Item1, Item2, Item3
edgy_smooth = ClusterInput()
merge_3 = Merge(Data1=item_2.Item, Data2=item_2.Item1, Data3=eval_2.Point, Data4=item_2.Item2, Data5=item_2.Item3)
nurbs = NurbsCurve(Vertices=merge_3, Degree=3, Periodic=False)  # -> Curve, Length, Domain
pline = PolyLine(Vertices=merge_3, Closed=False)
edgy_smooth_2 = Boolean(edgy_smooth)
bounding_cell = Curve(rectangle.Rectangle)
filter = StreamFilter(Gate=edgy_smooth_2, Stream0=nurbs.Curve, Stream1=pline)
periodic_curve = Curve(filter)
bounding_cell_2 = ClusterOutput(bounding_cell)
periodic_curve_2 = ClusterOutput(periodic_curve)

# ==== cluster SortPointByCircle
P = ClusterInput()
fcircle = CircleFit(Points=P)  # -> Circle, Radius, Deviation
alongcrv = SortAlongCurve(Points=P, Curve=fcircle.Circle)  # -> Points, Indices
P_2 = ClusterOutput(alongcrv.Points)
I = ClusterOutput(alongcrv.Indices)

# ==== cluster Cluster_6
cluster = Cluster_5(
    edgy_smooth=Toggle(False),
    control_perodic_crv_num_connections=Slider(0.27, range=0..1),
    control_perodic_crv_num_picks=Slider(0.15, range=0..1))  # -> periodic_curve_2, bounding_cell_2
data = Data(cluster.periodic_curve_2)
data_2 = ClusterOutput(data)
data_3 = Data(cluster.bounding_cell_2)
data_4 = ClusterOutput(data_3)

# ==== cluster Cluster_7
cluster = Cluster_5(
    edgy_smooth=Toggle(False),
    control_perodic_crv_num_connections=Slider(0.27, range=0..1),
    control_perodic_crv_num_picks=Slider(0.15, range=0..1))  # -> periodic_curve_2, bounding_cell_2
data = Data(cluster.periodic_curve_2)
data_2 = Data(cluster.bounding_cell_2)
data_3 = ClusterOutput(data)
data_4 = ClusterOutput(data_2)

# ==== cluster Cluster_9
cluster = Cluster_8(
    edgy_smooth=Toggle(False),
    control_perodic_crv_num_connections=Slider(0.27, range=0..1),
    control_perodic_crv_num_picks=Slider(0.15, range=0..1))  # -> periodic_curve_2, bounding_cell_2
data = Data(cluster.bounding_cell_2)
data_2 = Data(cluster.periodic_curve_2)
data_3 = ClusterOutput(data)
data_4 = ClusterOutput(data_2)

# ==== cluster Cluster_11
cluster = Cluster_10()  # -> periodic_curve_2, bounding_cell_2
data = Data(cluster.periodic_curve_2)
data_2 = Data(cluster.bounding_cell_2)
data_3 = ClusterOutput(data)
data_4 = ClusterOutput(data_2)

# ==== cluster Cluster_13
cluster = Cluster_12()  # -> periodic_curve_2, bounding_cell_2
data = Data(cluster.periodic_curve_2)
data_2 = Data(cluster.bounding_cell_2)
data_3 = ClusterOutput(data)
data_4 = ClusterOutput(data_2)

# ==== cluster LowestItem
K = ClusterInput()
A = ClusterInput()
sort = SortList(Keys=K, ValuesA=A)  # -> Keys, ValuesA
item = ListItem(List=reverse(sort.ValuesA), Index=0, Wrap=True)
i = ClusterOutput(item)

# ==== cluster Cluster_8
control_perodic_crv_num_connections = ClusterInput()
control_perodic_crv_num_picks = ClusterInput()
division = Division(A=Slider(500, range=0..1000), B="6")
control_perodic_crv_num_connections_2 = Number(control_perodic_crv_num_connections)
rectangle = Rectangle(Plane=PlaneXY(0, 0, 0), XSize="333.333", YSize=division, Radius=0)  # -> Rectangle, Length
control_perodic_crv_num_picks_2 = Number(control_perodic_crv_num_picks)
long = LongestList(ListA=rectangle.Rectangle, ListB=control_perodic_crv_num_connections_2, PaddingMode=2)  # -> ListA, ListB
explode = Explode(Curve=long.ListA, Recursive=True)  # -> Segments, Vertices
item = ListItem(List=explode.Segments, Index=0, Wrap=True)  # -> Item, Item1, Item2
expression = Expression(x=control_perodic_crv_num_picks_2, Expression="0.5+x")
expression_2 = Expression(x=control_perodic_crv_num_picks_2, Expression="0.5-x")
flip = FlipCurve(Curve=item.Item2)  # -> Curve, Flag
long_2 = LongestList(ListA="0", ListB=control_perodic_crv_num_connections_2, ListC=Slider(1, range=0..1), ListD="1", PaddingMode=2)  # -> ListA, ListB, ListC, ListD
long_3 = LongestList(ListA=Slider(1, range=0..1), ListB=".5", ListC=expression_2, PaddingMode=2)  # -> ListA, ListB, ListC
merge = Merge(Data1=graft(long_2.ListA), Data2=graft(long_2.ListB), Data3=graft(long_2.ListC), Data4=graft(long_2.ListD))
merge_2 = Merge(Data1=graft(long_3.ListC), Data2=graft(long_3.ListB), Data3=graft(long_3.ListA))

# ---- group: bottom
eval = EvaluateCurve(Curve=reparameterize(item.Item), Parameter=merge)  # -> Point, Tangent, Angle

# ---- group: top
eval_2 = EvaluateCurve(Curve=reparameterize(flip.Curve), Parameter=merge_2)  # -> flatten(Point), Tangent, Angle

# ----
panel = Panel(merge_2)
duppt = RemoveDuplicatePts(Points=eval.Point, Tolerance=0.01)
item_2 = ListItem(List=duppt, Index=0, Wrap=True)  # -> flatten(Item), flatten(Item1), flatten(Item2)
edgy_smooth = ClusterInput()
merge_3 = Merge(Data1=item_2.Item, Data2=item_2.Item1, Data3=eval_2.Point, Data4=item_2.Item2)
nurbs = NurbsCurve(Vertices=merge_3, Degree=3, Periodic=False)  # -> Curve, Length, Domain
pline = PolyLine(Vertices=merge_3, Closed=False)
edgy_smooth_2 = Boolean(edgy_smooth)
bounding_cell = Curve(rectangle.Rectangle)
filter = StreamFilter(Gate=edgy_smooth_2, Stream0=nurbs.Curve, Stream1=pline)
periodic_curve = Curve(filter)
bounding_cell_2 = ClusterOutput(bounding_cell)
periodic_curve_2 = ClusterOutput(periodic_curve)

# ==== cluster Cluster_10

# ---- group: Infill Custom
number_slider = Slider(0.27, range=0..1)
number_slider_2 = Slider(0.15, range=0..1)
toggle = BooleanToggle(False)

# ----
division = Division(A=Slider(500, range=0..1000), B="6")
rectangle = Rectangle(Plane=PlaneXY(0, 0, 0), XSize="333.333", YSize=division, Radius=0)  # -> Rectangle, Length
control_perodic_crv_num_connections = Number(number_slider)
control_perodic_crv_num_picks = Number(number_slider_2)
long = LongestList(ListA=rectangle.Rectangle, ListB=control_perodic_crv_num_connections, PaddingMode=2)  # -> ListA, ListB
number_slider_3 = Slider(0.51, range=0.51..1)
number_slider_4 = Slider(0.75, range=0..1)
explode = Explode(Curve=long.ListA, Recursive=True)  # -> Segments, Vertices
item = ListItem(List=explode.Segments, Index=0, Wrap=True)  # -> Item, Item1, Item2
number_slider_5 = Slider(1, range=0..1)
number_slider_6 = Slider(1, range=0..1)
expression = Expression(x=control_perodic_crv_num_picks, Expression="0.5+x")
expression_2 = Expression(x=control_perodic_crv_num_picks, Expression="0.5-x")
flip = FlipCurve(Curve=item.Item2)  # -> Curve, Flag
long_2 = LongestList(ListA="0", ListB=control_perodic_crv_num_connections, ListC=number_slider_3, ListD="1", PaddingMode=2)  # -> ListA, ListB, ListC, ListD
long_3 = LongestList(ListA=number_slider_3, ListB=".5", ListC=expression_2, PaddingMode=2)  # -> ListA, ListB, ListC
merge = Merge(Data1=graft(long_2.ListA), Data2=graft(long_2.ListB), Data3=graft(long_2.ListC), Data4=graft(long_2.ListD))
merge_2 = Merge(Data1=graft(long_3.ListC), Data2=graft(long_3.ListB), Data3=graft(long_3.ListA))

# ---- group: bottom
eval = EvaluateCurve(Curve=reparameterize(item.Item), Parameter=merge)  # -> Point, Tangent, Angle

# ---- group: top
eval_2 = EvaluateCurve(Curve=reparameterize(flip.Curve), Parameter=merge_2)  # -> flatten(Point), Tangent, Angle

# ----
panel = Panel(merge_2)
duppt = RemoveDuplicatePts(Points=eval.Point, Tolerance=0.01)
item_2 = ListItem(List=duppt, Index=0, Wrap=True)  # -> flatten(Item), flatten(Item1), flatten(Item2)
merge_3 = Merge(Data1=item_2.Item, Data2=item_2.Item1, Data3=eval_2.Point, Data4=item_2.Item2)
nurbs = NurbsCurve(Vertices=merge_3, Degree=3, Periodic=False)  # -> Curve, Length, Domain
pline = PolyLine(Vertices=merge_3, Closed=False)
edgy_smooth = Boolean(toggle)
bounding_cell = Curve(rectangle.Rectangle)
filter = StreamFilter(Gate=edgy_smooth, Stream0=nurbs.Curve, Stream1=pline)
periodic_curve = Curve(filter)
bounding_cell_2 = ClusterOutput(bounding_cell)
periodic_curve_2 = ClusterOutput(periodic_curve)

# ==== cluster Cluster_12

# ---- group: Infill Custom
number_slider = Slider(0.27, range=0..1)
number_slider_2 = Slider(0.15, range=0..1)
toggle = BooleanToggle(False)

# ----
division = Division(A=Slider(500, range=0..1000), B="6")
rectangle = Rectangle(Plane=PlaneXY(0, 0, 0), XSize="333.333", YSize=division, Radius=0)  # -> Rectangle, Length
control_perodic_crv_num_connections = Number(number_slider)
control_perodic_crv_num_picks = Number(number_slider_2)
long = LongestList(ListA=rectangle.Rectangle, ListB=control_perodic_crv_num_connections, PaddingMode=2)  # -> ListA, ListB
number_slider_3 = Slider(0.85, range=0.51..1)
number_slider_4 = Slider(0.75, range=0..1)
explode = Explode(Curve=long.ListA, Recursive=True)  # -> Segments, Vertices
item = ListItem(List=explode.Segments, Index=0, Wrap=True)  # -> Item, Item1, Item2
number_slider_5 = Slider(1, range=0..1)
number_slider_6 = Slider(1, range=0..1)
expression = Expression(x=control_perodic_crv_num_picks, Expression="0.5+x")
expression_2 = Expression(x=control_perodic_crv_num_picks, Expression="0.5-x")
flip = FlipCurve(Curve=item.Item2)  # -> Curve, Flag
long_2 = LongestList(ListA="0", ListB=control_perodic_crv_num_connections, ListC=number_slider_3, ListD="1", PaddingMode=2)  # -> ListA, ListB, ListC, ListD
long_3 = LongestList(ListA=number_slider_3, ListB=".5", ListC=expression_2, PaddingMode=2)  # -> ListA, ListB, ListC
merge = Merge(Data1=graft(long_2.ListA), Data2=graft(long_2.ListB), Data3=graft(long_2.ListC), Data4=graft(long_2.ListD))
merge_2 = Merge(Data1=graft(long_3.ListC), Data2=graft(long_3.ListB), Data3=graft(long_3.ListA))

# ---- group: bottom
eval = EvaluateCurve(Curve=reparameterize(item.Item), Parameter=merge)  # -> Point, Tangent, Angle

# ---- group: top
eval_2 = EvaluateCurve(Curve=reparameterize(flip.Curve), Parameter=merge_2)  # -> flatten(Point), Tangent, Angle

# ----
panel = Panel(merge_2)
duppt = RemoveDuplicatePts(Points=eval.Point, Tolerance=0.01)
item_2 = ListItem(List=duppt, Index=0, Wrap=True)  # -> flatten(Item), flatten(Item1), flatten(Item2)
merge_3 = Merge(Data1=item_2.Item, Data2=item_2.Item1, Data3=eval_2.Point, Data4=item_2.Item2)
nurbs = NurbsCurve(Vertices=merge_3, Degree=3, Periodic=False)  # -> Curve, Length, Domain
pline = PolyLine(Vertices=merge_3, Closed=False)
edgy_smooth = Boolean(toggle)
bounding_cell = Curve(rectangle.Rectangle)
filter = StreamFilter(Gate=edgy_smooth, Stream0=nurbs.Curve, Stream1=pline)
periodic_curve = Curve(filter)
bounding_cell_2 = ClusterOutput(bounding_cell)
periodic_curve_2 = ClusterOutput(periodic_curve)
